# Dynamo graph DimensionFraming.dyn (Dynamo 2.3.0.5885)

# group: OK
boolean = BoolSelector(false)
file_path_select_elements = Filename("..\..\DYNAMO_PVN\2. WORKING\Code Python Import Into Dyn\02_ Dimension_Fraiming_Detail.py")
python_script = Python(IN[0]=boolean, IN[1]=file_path_select_elements)
# ---------- python_script.python (4 lines) ----------
if IN[0] == True:
	OUT = IN[1]
else:
	OUT = IN[1]
# ----------------------------------------
readText = FileSystem.ReadText(file=python_script)
distance_between_dimensions = DoubleInput(300)
flip_dimension_true_1_false_1 = BoolSelector(false)
python_script_2 = Python(IN[0]=flip_dimension_true_1_false_1)
# ---------- python_script_2.python (4 lines) ----------
if IN[0] == True:
	OUT = 1
else:
	OUT = -1
# ----------------------------------------
# note: HomeWork : Framing Dimension
n02__dimension_fraiming_detail = PythonStringNode(script=readText, IN[1]=distance_between_dimensions, IN[2]=python_script_2)  # "02_ Dimension_Fraiming_Detail"; frozen; unwired: IN[0]
type = Object.Type(obj=n02__dimension_fraiming_detail)

# group: OK
boolean_2 = BoolSelector(false)
file_path_select_elements_2 = Filename("..\..\DYNAMO_PVN\2. WORKING\Code Python Import Into Dyn\01_Dimension_Boundary.py")
python_script_3 = Python(IN[0]=boolean_2, IN[1]=file_path_select_elements_2)  # same code as python_script
readText_2 = FileSystem.ReadText(file=python_script_3)
n01_Dimension_Boundary = PythonStringNode(script=readText_2)  # "01_Dimension_Boundary"

surface = Python()  # unwired: IN[0]
# ---------- surface.python (17 lines) ----------
import clr
clr.AddReference('RevitAPI')
from Autodesk.Revit.DB import *
clr.AddReference('DSCoreNodes')
from DSCore import *

list = UnwrapElement(IN[0])
el = []


for i in list:
    re =[]
    for j in i:
        re.append(j.Tags.LookupTag("RevitFaceReference"))
    el.append(re)

OUT = el;
# ----------------------------------------
code_block = CodeBlock { curveline; }  # unwired: curveline
python_script_4 = Python(IN[0]=code_block)
# ---------- python_script_4.python (34 lines) ----------
#Copyright (c) 2018, pvnhinh92@gmail.com
import clr
clr.AddReference('RevitAPI')
from Autodesk.Revit.DB import *

import clr
clr.AddReference('DSCoreNodes')
from DSCore import *

clr.AddReference('RevitServices')
import RevitServices
from RevitServices.Persistence import DocumentManager
from RevitServices.Transactions import TransactionManager

doc = DocumentManager.Instance.CurrentDBDocument

clr.AddReference('RevitNodes')
import Revit
clr.ImportExtensions(Revit.Elements)
clr.ImportExtensions(Revit.GeometryConversion)

lines = IN[0]

opt = Options()
opt.ComputeReferences = True
opt.IncludeNonVisibleObjects = True
opt.View = doc.ActiveView

ln =[]
for i in lines:
	line = UnwrapElement(i).ToRevitType()
	ln.append(line)
OUT = ln
	
# ----------------------------------------
python_script_5 = Python(IN[0]=python_script_4)  # unwired: IN[1], IN[2]
# ---------- python_script_5.python (50 lines) ----------
#Copyright (c) 2018, pvnhinh92@gmail.com
import clr
clr.AddReference('RevitAPI')
from Autodesk.Revit.DB import *

import clr
clr.AddReference('DSCoreNodes')
from DSCore import *

clr.AddReference('RevitServices')
import RevitServices
from RevitServices.Persistence import DocumentManager
from RevitServices.Transactions import TransactionManager

doc = DocumentManager.Instance.CurrentDBDocument

clr.AddReference('RevitNodes')
import Revit
clr.ImportExtensions(Revit.Elements)
clr.ImportExtensions(Revit.GeometryConversion)

Su = IN[1]
i = 0
lines = IN[0]
DIM = []

if IN[2] == True:
	
	
	opt = Options()
	opt.ComputeReferences = True
	opt.IncludeNonVisibleObjects = True
	opt.View = doc.ActiveView

	b= range(0,len(Su))
	for i in b:
		line = lines[i]
		rf = ReferenceArray()
		l = Su[i]
		for j in l:
			rf.Append(j)
		TransactionManager.Instance.EnsureInTransaction(doc)
		dim = doc.Create.NewDimension(opt.View, line, rf)
		DIM.append(dim)
		TransactionManager.Instance.TransactionTaskDone();
					

	OUT = DIM
else:
	OUT = 'Set to Run is True!'
# ----------------------------------------
boolean_3 = BoolSelector(false)
file_path_select_elements_3 = Filename("..\..\DYNAMO_PVN\2. WORKING\Code Python Import Into Dyn\04_Template_DefunctOfList.py")
python_script_6 = Python(IN[0]=boolean_3, IN[1]=file_path_select_elements_3)  # unwired: IN[2]; same code as python_script
readText_3 = FileSystem.ReadText(file=python_script_6)
select_model_elements = DSModelElementsSelection()  # 4 picked in the model
code_block_2 = CodeBlock { 1; }
flatten = List.Flatten(list=select_model_elements, amt=code_block_2)
code_block_3 = CodeBlock { 2; }
chop = List.Chop(list=flatten, lengths=code_block_3)
n01_Dimension_Boundary_2 = PythonStringNode(script=readText_3, IN[2]=chop)  # "01_Dimension_Boundary"; unwired: IN[0], IN[1]
python_script_7 = Python()  # unwired: IN[0]
# ---------- python_script_7.python (7 lines) ----------
a = [1,2,3,4,5,6,7,8,9,10]
def chunks(l, n):
    n = max(1, n)
    return (l[i:i+n] for i in range(0, len(l), n))


OUT = chunks(a,2)
# ----------------------------------------
boolean_4 = BoolSelector(true)
file_path_select_elements_4 = Filename("..\..\DYNAMO_PVN\2. WORKING\Code Python Import Into Dyn\03_DimensionFramingSpaceFraming.py")
python_script_8 = Python(IN[0]=boolean_4, IN[1]=file_path_select_elements_4)  # unwired: IN[2]; same code as python_script
readText_4 = FileSystem.ReadText(file=python_script_8)
n03_DimensionFramingSpaceFraming = PythonStringNode(script=readText_4)  # "03_DimensionFramingSpaceFraming"; frozen; unwired: IN[0], IN[1]
code_block_4 = CodeBlock(a=n03_DimensionFramingSpaceFraming) { a[0]; }
code_block_5 = CodeBlock(a=n03_DimensionFramingSpaceFraming) { a[1]; }
code_block_6 = CodeBlock { 2; }
chop_2 = List.Chop(list=code_block_5, lengths=code_block_6)
python_script_9 = Python(IN[1]=code_block_4, IN[2]=chop_2)  # unwired: IN[0]
# ---------- python_script_9.python (35 lines) ----------
import clr
import System
import math 
from System.Collections.Generic import *

clr.AddReference('ProtoGeometry')
from Autodesk.DesignScript.Geometry import *

clr.AddReference('RevitAPI')
import Autodesk
from Autodesk.Revit.DB import *

clr.AddReference('RevitAPIUI')
from Autodesk.Revit.UI import*
from  Autodesk.Revit.UI.Selection import*

clr.AddReference("RevitNodes")
import Revit
clr.ImportExtensions(Revit.Elements)
clr.ImportExtensions(Revit.GeometryConversion)

clr.AddReference("RevitServices")
import RevitServices
from RevitServices.Persistence import DocumentManager
from RevitServices.Transactions import TransactionManager

doc = DocumentManager.Instance.CurrentDBDocument
view = doc.ActiveView
uidoc = DocumentManager.Instance.CurrentUIApplication.ActiveUIDocument

TransactionManager.Instance.EnsureInTransaction(doc)

dim1 = doc.Create.NewDimension(view, IN[1], IN[2])

TransactionManager.Instance.TransactionTaskDone()
# ----------------------------------------
dimension_true_detail_flase = BoolSelector(false)  # "Dimension: True = Detail ; Flase = Element"; graph input
refesh = BoolSelector(true)  # graph input
file_path_select_elements_5 = Filename("..\..\..\..\..\DYNAMO_PVN\2. WORKING\Code Python Import Into Dyn\04_DimensionFramingDetail.py")  # graph input
python_script_10 = Python(IN[0]=refesh, IN[1]=file_path_select_elements_5)  # frozen; unwired: IN[2]; same code as python_script
readText_5 = FileSystem.ReadText(file=python_script_10)

# group: GRIDS
number = DoubleInput(300)
boolean_5 = BoolSelector(true)
python_script_11 = Python(IN[0]=boolean_5)  # same code as python_script_2
boolean_6 = BoolSelector(false)

n01_Dimension_Boundary_3 = PythonStringNode(script=readText_5, IN[1]=number, IN[2]=python_script_11)  # "01_Dimension_Boundary"; unwired: IN[0]

# group: Get Value
element_surface = CodeBlock(a=n01_Dimension_Boundary_3) { a[1]; }
line = CodeBlock(a=n01_Dimension_Boundary_3) { a[0]; }  # "Revit.DB.Line"
refOfGrids = CodeBlock(a=n01_Dimension_Boundary_3) { a[2]; }
getLineGrids = CodeBlock(a=n01_Dimension_Boundary_3) { a[3]; }

# group: Filter
python_script_12 = Python(IN[1]=element_surface, IN[2]=line)  # unwired: IN[0]
# ---------- python_script_12.python (11 lines) ----------
# Load the Python Standard and DesignScript Libraries
import sys
import clr
clr.AddReference('ProtoGeometry')
from Autodesk.DesignScript.Geometry import *

re = []
for i in range(len(IN[1])):
	re.append(IN[2])

OUT = re
# ----------------------------------------
fn_fiter_2 = Python(IN[1]=element_surface, IN[2]=refOfGrids, IN[3]=getLineGrids)  # unwired: IN[0]
# ---------- fn_fiter_2.python (32 lines) ----------
import clr
clr.AddReference('ProtoGeometry')
from Autodesk.DesignScript.Geometry import *
#The inputs to this node will be stored as a list in the IN variables.
clr.AddReference('DSCoreNodes')
from DSCore import *

lst = IN[3]
su = IN[1]
gr = IN[2]


Ref=[]
for i in range(0,len(su)):
	dis =[]
	for j in su[i]:
		dis.append(lst[i].DistanceTo(j))
	#if dis[0] !=0 and dis[1] !=0:
		#su[i].insert(0,lst[i])
		#su[i].insert(0,gr[i])
		
for i in range(0,len(su)):
	re =[]
	for j in su[i]:
		if str(j).Contains('Surface'):
			re.append(j.Tags.LookupTag("RevitFaceReference"))
		else:
			re.append(j)
	Ref.append(re)

OUT= Ref
			
# ----------------------------------------
fn_fiter_2_2 = Python(IN[1]=element_surface, IN[2]=refOfGrids, IN[3]=getLineGrids)  # unwired: IN[0]
# ---------- fn_fiter_2_2.python (32 lines) ----------
import clr
clr.AddReference('ProtoGeometry')
from Autodesk.DesignScript.Geometry import *
#The inputs to this node will be stored as a list in the IN variables.
clr.AddReference('DSCoreNodes')
from DSCore import *

lst = IN[3]
su = IN[1]
gr = IN[2]


Ref=[]
for i in range(0,len(su)):
	dis =[]
	for j in su[i]:
		dis.append(lst[i].DistanceTo(j))
	if dis[0] !=0 and dis[1] !=0:
		#su[i].insert(0,lst[i])
		su[i].insert(0,gr[i])
		
for i in range(0,len(su)):
	re =[]
	for j in su[i]:
		if str(j).Contains('Surface'):
			re.append(j.Tags.LookupTag("RevitFaceReference"))
		else:
			re.append(j)
	Ref.append(re)

OUT= Ref
			
# ----------------------------------------

get_kind_of_dimension = Python(IN[0]=dimension_true_detail_flase, IN[1]=python_script_12, IN[2]=fn_fiter_2)
# ---------- get_kind_of_dimension.python (4 lines) ----------
if IN[0] == True:
	OUT = IN[1]
else:
	OUT = IN[2]
# ----------------------------------------
boolean_7 = BoolSelector(true)
dimension_elements_and_grid = Python(IN[0]=get_kind_of_dimension, IN[1]=fn_fiter_2_2, IN[2]=boolean_7)
# ---------- dimension_elements_and_grid.python (49 lines) ----------
import clr
clr.AddReference('RevitAPI')
from Autodesk.Revit.DB import *

import clr
clr.AddReference('DSCoreNodes')
from DSCore import *

clr.AddReference('RevitServices')
import RevitServices
from RevitServices.Persistence import DocumentManager
from RevitServices.Transactions import TransactionManager

doc = DocumentManager.Instance.CurrentDBDocument

clr.AddReference('RevitNodes')
import Revit
clr.ImportExtensions(Revit.Elements)
clr.ImportExtensions(Revit.GeometryConversion)

Su = IN[1]
i = 0
lines = IN[0]
DIM = []

if IN[2] == True:
	
	
	opt = Options()
	opt.ComputeReferences = True
	opt.IncludeNonVisibleObjects = True
	opt.View = doc.ActiveView

	b= range(0,len(Su))
	for i in b:
		line = lines[i]
		rf = ReferenceArray()
		l = Su[i]
		for j in l:
			rf.Append(j)
		TransactionManager.Instance.EnsureInTransaction(doc)
		dim = doc.Create.NewDimension(opt.View, line, rf)
		DIM.append(dim)
		TransactionManager.Instance.TransactionTaskDone();
					

	OUT = DIM
else:
	OUT = 'Set to Run is True!'
# ----------------------------------------
dimension_elements = Python(IN[0]=python_script_12, IN[1]=get_kind_of_dimension, IN[2]=boolean_7)  # same code as dimension_elements_and_grid

# group (continued): GRIDS
python_script_13 = Python(IN[0]=boolean_6, IN[1]=n01_Dimension_Boundary_3, IN[2]=line)
# ---------- python_script_13.python (4 lines) ----------
if IN[0] == True:
	OUT = IN[1][4],IN[2]
else:
	OUT = " KHÔNG CHO DIM BẠN EY"
# ----------------------------------------
code_block_7 = CodeBlock(a=python_script_13) { a[1]; }
dimension_grid = Python(IN[0]=code_block_7, IN[1]=refOfGrids, IN[2]=python_script_13)
# ---------- dimension_grid.python (51 lines) ----------
import clr
clr.AddReference('RevitAPI')
from Autodesk.Revit.DB import *

import clr
clr.AddReference('DSCoreNodes')
from DSCore import *

clr.AddReference('RevitServices')
import RevitServices
from RevitServices.Persistence import DocumentManager
from RevitServices.Transactions import TransactionManager

doc = DocumentManager.Instance.CurrentDBDocument

clr.AddReference('RevitNodes')
import Revit
clr.ImportExtensions(Revit.Elements)
clr.ImportExtensions(Revit.GeometryConversion)

doc = DocumentManager.Instance.CurrentDBDocument
view = doc.ActiveView
uidoc = DocumentManager.Instance.CurrentUIApplication.ActiveUIDocument



allRef = IN[1]
i = 0
line = IN[0]
Ofline = IN[2]
DIM = []

refboundary = IN[1][1:3]

re1 = ReferenceArray()
for i in allRef:
    re1.Append(i)



re2 = ReferenceArray()
for i in refboundary:
    re2.Append(i)

TransactionManager.Instance.EnsureInTransaction(doc)
dim = doc.Create.NewDimension(view, line, re1)
#dim1 = doc.Create.NewDimension(view, Ofline, re2 )
DIM.append(dim)
TransactionManager.Instance.TransactionTaskDone();
					
OUT = DIM,refboundary
# ----------------------------------------

# group: 03_DimensionFraming_Framing
boolean_8 = BoolSelector(false)
file_path_select_elements_6 = Filename("..\..\DYNAMO_PVN\2. WORKING\Code Python Import Into Dyn\03_DimensionFraming_Framing.py")
python_script_14 = Python(IN[0]=boolean_8, IN[1]=file_path_select_elements_6)  # unwired: IN[2]; same code as python_script
readText_6 = FileSystem.ReadText(file=python_script_14)
n03_DimensionFraming_Framing = PythonStringNode(script=readText_6)  # "03_DimensionFraming_Framing"; unwired: IN[0], IN[1]
