# Dynamo graph Auto Dimension Structural.dyn (Dynamo 2.3.0.5885)
# packages: WombatDynamo 1.3.2

select_model_elements = DSModelElementsSelection()  # 2 picked in the model; graph input
faces = Element.Faces(element=select_model_elements)
code_block = CodeBlock(surface=faces)
# ---------- code_block.designscript (8 lines) ----------
vector1 = surface.NormalAtParameter(0, 0);
vector2 = Autodesk.Vector.ZAxis();
t4 = vector1.AngleWithVector(vector2);
x = Ag = 30;
t1 = 180 - x;
Bot = t4 >= t1;
Top = t4 <= Ag;
Other = Bot || Top;
# ----------------------------------------
filterByBoolMask = Python(IN[0]=code_block.Other, IN[1]=faces)
# ---------- filterByBoolMask.python (42 lines) ----------
import clr
import System

clr.AddReference("RevitServices")
import RevitServices
from RevitServices.Persistence import DocumentManager
doc =  DocumentManager.Instance.CurrentDBDocument
 
clr.AddReference("RevitNodes")
import Revit
clr.ImportExtensions(Revit.Elements)
clr.ImportExtensions(Revit.GeometryConversion)
 
clr.AddReference("RevitAPI")
from Autodesk.Revit.DB import *

clr.AddReference('DSCoreNodes')
from DSCore import *

bool = IN[0]
face = IN[1]

index =[]

result = []
for i in IN[0]:
	ls =[]
	for j in i:
		j = True if j == False else False
		ls.append(j)
	result.append(ls)


for i in range(0,len(result)):
	lst=[]
	for j in range(0,len(result[i])):
		if result[i][j] == True:
			lst.append(face[i][j])
	index.append(lst)


OUT = index
# ----------------------------------------
code_block_2 = CodeBlock(x=filterByBoolMask) { x; }
code_block_3 = CodeBlock { 0.5; }
normalAtParameter = Surface.NormalAtParameter(surface=code_block_2, u=code_block_3, v=code_block_3)
YAxis = Vector.YAxis()
isParallel = Vector.IsParallel(vector=normalAtParameter, other=YAxis)
filterByBoolMask_2 = List.FilterByBoolMask(list=code_block_2, mask=isParallel)
boolean = BoolSelector(true)
# note: Dynamo Auto_Dimemsion Structural
# Install Package:
# + WombatDynamo
# + Dynamo 2.3
# Reference by : https://www.youtube.com/watch?v=l4OzLTpnlCA&t=2s
# BIM Solution PV
# Develop more by: https://www.facebook.com/duengocnguyen/
# Refer to that Video link to use: https://www.youtube.com/watch?v=Y8oWPnCNby0&t=24s
boolean_2 = BoolSelector(false)
python_script = Python(IN[0]=boolean_2)
# ---------- python_script.python (41 lines) ----------
import clr
clr.AddReference('ProtoGeometry')
from Autodesk.DesignScript.Geometry import *

# Import DocumentManager and TransactionManager
clr.AddReference("RevitServices")
import RevitServices
from RevitServices.Persistence import DocumentManager
from RevitServices.Transactions import TransactionManager
doc = DocumentManager.Instance.CurrentDBDocument

# Import RevitAPI
clr.AddReference("RevitAPI")
import Autodesk
from Autodesk.Revit.DB import *

# Import ToDSType(bool) extension method
clr.AddReference("RevitNodes")
import Revit
clr.ImportExtensions(Revit.Elements)

#The inputs to this node will be stored as a list in the IN variable.
dataEnteringNode = IN

dTypes = FilteredElementCollector(doc).OfClass(DimensionType)
sTypes = FilteredElementCollector(doc).OfClass(SpotDimensionType)

sTypesName = []
for i in sTypes:
	sTypesName.append(i.ToDSType(True).Name)

dimensionTypes = []
for i in dTypes:
	if i.ToDSType(True).Name not in sTypesName:
		dimensionTypes.append(i.ToDSType(True))
name = []
for i in dimensionTypes:
	name.append(i.Name)

#Assign your output to the OUT variable
OUT = dimensionTypes, name
# ----------------------------------------
code_block_4 = CodeBlock(x=python_script) { x[1]; x[0]; }
code_block_5 = CodeBlock(x=code_block_4.out0) { x; }
python_script_2 = Python(IN[0]=boolean, IN[1]=code_block_5)
# ---------- python_script_2.python (170 lines) ----------
import clr
import sys

clr.AddReference('RevitAPI')
clr.AddReference('RevitServices')

import Autodesk
import RevitServices

from Autodesk.Revit.DB import*
from RevitServices.Persistence import*

import clr
clr.AddReference('ProtoGeometry')
clr.AddReference('System.Windows.Forms')
clr.AddReference('System.Drawing')

import System.Drawing
import System.Windows.Forms

from System.Drawing import *
from System.Windows.Forms import * 
from System import*



Type = list(IN[1])
type =[i for i in Type]

class MainForm(Form):
	def __init__(self):
		self.InitializeComponent()
	
	def InitializeComponent(self):
	
		self.outCat = []
		self._groupBox2 = System.Windows.Forms.GroupBox()
		self._label4 = System.Windows.Forms.Label()
		self._label5 = System.Windows.Forms.Label()
		self._cbbType = System.Windows.Forms.ComboBox()
		self._tbOffset = System.Windows.Forms.TextBox()


		self._label6 = System.Windows.Forms.Label()
		self._btnCancel = System.Windows.Forms.Button()
		self._btnOk = System.Windows.Forms.Button()
		self._groupBox2.SuspendLayout()
		self.SuspendLayout()
		# groupBox2
		# 
	
		self._groupBox2.Controls.Add(self._tbOffset)
		self._groupBox2.Controls.Add(self._cbbType)
		self._groupBox2.Controls.Add(self._label5)
		self._groupBox2.Controls.Add(self._label4)
		self._groupBox2.Font = System.Drawing.Font("Microsoft Sans Serif", 8.25, System.Drawing.FontStyle.Bold, System.Drawing.GraphicsUnit.Point, 0)
		self._groupBox2.Location = System.Drawing.Point(120, 3)
		self._groupBox2.Name = "groupBox2"
		self._groupBox2.Size = System.Drawing.Size(228, 140)
		self._groupBox2.TabIndex = 1
		self._groupBox2.TabStop = False
		self._groupBox2.Text = "Dimension Options"
		# 
		# label4
		# 
		self._label4.Font = System.Drawing.Font("Microsoft Sans Serif", 8.25, System.Drawing.FontStyle.Regular, System.Drawing.GraphicsUnit.Point, 0)
		self._label4.Location = System.Drawing.Point(6, 22)
		self._label4.Name = "label4"
		self._label4.Size = System.Drawing.Size(45, 23)
		self._label4.TabIndex = 0
		self._label4.Text = "Offset :"
		# 
		# label5
		# 
		self._label5.Font = System.Drawing.Font("Microsoft Sans Serif", 8.25, System.Drawing.FontStyle.Regular, System.Drawing.GraphicsUnit.Point, 0)
		self._label5.Location = System.Drawing.Point(6, 57)
		self._label5.Name = "label5"
		self._label5.Size = System.Drawing.Size(45, 23)
		self._label5.TabIndex = 1
		self._label5.Text = "Type :"
		# 
		# cbbType
		# 
		self._cbbType.Font = System.Drawing.Font("Microsoft Sans Serif", 8.25, System.Drawing.FontStyle.Regular, System.Drawing.GraphicsUnit.Point, 0)
		self._cbbType.FormattingEnabled = True
		self._cbbType.Location = System.Drawing.Point(57, 54)
		self._cbbType.Name = "cbbType"
		self._cbbType.Size = System.Drawing.Size(156, 21)
		self._cbbType.TabIndex = 6
		self._cbbType.Items.AddRange(System.Array[System.Object](type))
		# 
		# tbOffset
		# 
		self._tbOffset.Font = System.Drawing.Font("Microsoft Sans Serif", 8.25, System.Drawing.FontStyle.Regular, System.Drawing.GraphicsUnit.Point, 0)
		self._tbOffset.Location = System.Drawing.Point(57, 19)
		self._tbOffset.Name = "tbOffset"
		self._tbOffset.Size = System.Drawing.Size(156, 20)
		self._tbOffset.TabIndex = 7
		self._tbOffset.Text = "600"
		# 

		# 

		# 
		# label6
		# 
		self._label6.Location = System.Drawing.Point(3, 169)
		self._label6.Name = "label6"
		self._label6.Size = System.Drawing.Size(236, 18)
		self._label6.TabIndex = 2
		self._label6.Text ="duengocnguyen@gmail.com"
		# 
		# btnCancel
		# 
		self._btnCancel.Location = System.Drawing.Point(413, 164)
		self._btnCancel.Name = "btnOk"
		self._btnCancel.Size = System.Drawing.Size(75, 23)
		self._btnCancel.TabIndex = 4
		self._btnCancel.Text = "Cancel"
		self._btnCancel.UseVisualStyleBackColor = True
		self._btnCancel.Click += self.BtnCancelClick
		# 
		# btnOk
		# 
		self._btnOk.Location = System.Drawing.Point(332, 164)
		self._btnOk.Name = "btnCancel"
		self._btnOk.Size = System.Drawing.Size(75, 23)
		self._btnOk.TabIndex = 5
		self._btnOk.Text = "OK"
		self._btnOk.UseVisualStyleBackColor = True
		self._btnOk.Click += self.BtnOkClick
		# 
		# MainForm
		# 
		self.AutoSizeMode = System.Windows.Forms.AutoSizeMode.GrowAndShrink
		self.ClientSize = System.Drawing.Size(492, 194)
		self.Controls.Add(self._btnOk)
		self.Controls.Add(self._btnCancel)
		self.Controls.Add(self._label6)
		self.Controls.Add(self._groupBox2)

		self.MaximizeBox = False
		self.MinimizeBox = False
		self.Name = "MainForm"
		self.ShowIcon = False
		self.SizeGripStyle = System.Windows.Forms.SizeGripStyle.Hide
		self.StartPosition = System.Windows.Forms.FormStartPosition.CenterParent
		self.Text = "Auto Dimension"
		self.TopMost = True

		self._groupBox2.ResumeLayout(False)
		self._groupBox2.PerformLayout()
		self.ResumeLayout(False)
		self.out = ""
		
		
	def BtnCancelClick(self, sender, e):
		self.Close()
		pass

	def BtnOkClick(self, sender, e):
		self.out =[]
		self.outR =[]
		self.out.append(self._tbOffset.Text)
		self.out.append(self._cbbType.Text)
		self.Close()
		pass
f = MainForm()
Application.Run(f)
OUT = f.out
# ----------------------------------------
code_block_6 = CodeBlock(a=python_script_2) { a[1]; a[0]; }

# group: Vector X
offset = CodeBlock(distance=code_block_6.out1) { distance; }
code_block_7 = CodeBlock(SurfaceY=filterByBoolMask_2.out) { SurfaceY; }
surface_oy = Python(IN[0]=code_block_7)
# ---------- surface_oy.python (17 lines) ----------
import clr
clr.AddReference('RevitAPI')
from Autodesk.Revit.DB import *
clr.AddReference('DSCoreNodes')
from DSCore import *

list = UnwrapElement(IN[0])
el = []


for i in list:
    re =[]
    for j in i:
        re.append(j.Tags.LookupTag("RevitFaceReference"))
    el.append(re)

OUT = el;
# ----------------------------------------
left_true_right_false = BoolSelector(true)  # graph input
perimeterCurves = Surface.PerimeterCurves(surface=code_block_7)
code_block_8 = CodeBlock { 0; 1; }
left = List.GetItemAtIndex(list=perimeterCurves, index=code_block_8.out1, lacing=Longest)
right = List.GetItemAtIndex(list=perimeterCurves, index=code_block_8.out0, lacing=Longest)
direction_dimension = CodeBlock(bottom=left_true_right_false, l=left, r=right) { bottom == true? l:r; }
other__take_line_on_top_surface = Python(IN[0]=direction_dimension)  # "Other_ Take Line On Top Surface (Left)"
# ---------- other__take_line_on_top_surface.python (14 lines) ----------
import clr
clr.AddReference('ProtoGeometry')
from Autodesk.DesignScript.Geometry import *

clr.AddReference('DSCoreNodes')
from DSCore import *

re = []
for i in IN[0]:
	c = i[0]
	re.append(c)

	
OUT = re
# ----------------------------------------
toNumber = String.ToNumber(str=offset)
code_block_9 = CodeBlock(x=toNumber) { -x; }
curve_y_smartoffset = WombatDynamo.Curve.SmartOffset(curve=other__take_line_on_top_surface, offsetDist=code_block_9)

# group: Vector Y take lines from members's surfaces
top_true_bottom_false = BoolSelector(true)  # graph input
code_block_10 = CodeBlock(SurfaceX=filterByBoolMask_2.in) { SurfaceX; }
perimeterCurves_2 = Surface.PerimeterCurves(surface=code_block_10)
code_block_11 = CodeBlock { 0; 1; }
top = List.GetItemAtIndex(list=perimeterCurves_2, index=code_block_11.out1, lacing=Longest)
bottom = List.GetItemAtIndex(list=perimeterCurves_2, index=code_block_11.out0, lacing=Longest)
direction_dimension_2 = CodeBlock(bottom=top_true_bottom_false, t=top, b=bottom) { bottom == true? t:b; }
n64_4_16_other = Python(IN[0]=direction_dimension_2)  # "64 / 4 =16 Other"; same code as other__take_line_on_top_surface
toNumber_2 = String.ToNumber(str=offset)
code_block_12 = CodeBlock(y=toNumber_2) { -y; }
curve_x_smartoffset = WombatDynamo.Curve.SmartOffset(curve=n64_4_16_other, offsetDist=code_block_12)
surface = Python(IN[0]=code_block_10)  # same code as surface_oy

code_block_13 = CodeBlock(x=code_block_4.out0, y=code_block_6.out0) { x==y; }
filterByBoolMask_3 = List.FilterByBoolMask(list=code_block_4.out1, mask=code_block_13)
code_block_14 = CodeBlock(x=filterByBoolMask_3.in) { x[0]; }

# group: Dimension Detail Element
direction_ox = CodeBlock(curveline=curve_x_smartoffset) { curveline; }
python_script_3 = Python(IN[0]=direction_ox)
# ---------- python_script_3.python (33 lines) ----------
import clr
clr.AddReference('RevitAPI')
from Autodesk.Revit.DB import *

import clr
clr.AddReference('DSCoreNodes')
from DSCore import *

clr.AddReference('RevitServices')
import RevitServices
from RevitServices.Persistence import DocumentManager
from RevitServices.Transactions import TransactionManager

doc = DocumentManager.Instance.CurrentDBDocument

clr.AddReference('RevitNodes')
import Revit
clr.ImportExtensions(Revit.Elements)
clr.ImportExtensions(Revit.GeometryConversion)

lines = IN[0]

opt = Options()
opt.ComputeReferences = True
opt.IncludeNonVisibleObjects = True
opt.View = doc.ActiveView

ln =[]
for i in lines:
	line = UnwrapElement(i).ToRevitType()
	ln.append(line)
OUT = ln
	
# ----------------------------------------
code_block_15 = CodeBlock { true; }
python_script_dim_ox = Python(IN[0]=python_script_3, IN[1]=surface_oy, IN[2]=code_block_15)
# ---------- python_script_dim_ox.python (49 lines) ----------
import clr
clr.AddReference('RevitAPI')
from Autodesk.Revit.DB import *

import clr
clr.AddReference('DSCoreNodes')
from DSCore import *

clr.AddReference('RevitServices')
import RevitServices
from RevitServices.Persistence import DocumentManager
from RevitServices.Transactions import TransactionManager

doc = DocumentManager.Instance.CurrentDBDocument

clr.AddReference('RevitNodes')
import Revit
clr.ImportExtensions(Revit.Elements)
clr.ImportExtensions(Revit.GeometryConversion)

Su = IN[1]
i = 0
lines = IN[0]
DIM = []

if IN[2] == True:
	
	
	opt = Options()
	opt.ComputeReferences = True
	opt.IncludeNonVisibleObjects = True
	opt.View = doc.ActiveView

	b= range(0,len(Su))
	for i in b:
		line = lines[i]
		rf = ReferenceArray()
		l = Su[i]
		for j in l:
			rf.Append(j)
		TransactionManager.Instance.EnsureInTransaction(doc)
		dim = doc.Create.NewDimension(opt.View, line, rf)
		DIM.append(dim)
		TransactionManager.Instance.TransactionTaskDone();
					

	OUT = DIM,rf
else:
	OUT = 'Set to Run is True!'
# ----------------------------------------
direction_oy = CodeBlock(curveline=curve_y_smartoffset) { curveline; }
python_script_4 = Python(IN[0]=direction_oy)  # same code as python_script_3
python_script_dim_oy = Python(IN[0]=python_script_4, IN[1]=surface, IN[2]=code_block_15)
# ---------- python_script_dim_oy.python (49 lines) ----------
import clr
clr.AddReference('RevitAPI')
from Autodesk.Revit.DB import *

import clr
clr.AddReference('DSCoreNodes')
from DSCore import *

clr.AddReference('RevitServices')
import RevitServices
from RevitServices.Persistence import DocumentManager
from RevitServices.Transactions import TransactionManager

doc = DocumentManager.Instance.CurrentDBDocument

clr.AddReference('RevitNodes')
import Revit
clr.ImportExtensions(Revit.Elements)
clr.ImportExtensions(Revit.GeometryConversion)

Su = IN[1]
i = 0
lines = IN[0]
DIM = []

if IN[2] == True:
	
	
	opt = Options()
	opt.ComputeReferences = True
	opt.IncludeNonVisibleObjects = True
	opt.View = doc.ActiveView

	b= range(0,len(Su))
	for i in b:
		line = lines[i]
		rf = ReferenceArray()
		l = Su[i]
		for j in l:
			rf.Append(j)
		TransactionManager.Instance.EnsureInTransaction(doc)
		dim = doc.Create.NewDimension(opt.View, line, rf)
		DIM.append(dim)
		TransactionManager.Instance.TransactionTaskDone();
					

	OUT = DIM
else:
	OUT = 'Set to Run is True!'
# ----------------------------------------
join = List.Join(list0=python_script_dim_ox, list1=python_script_dim_oy)
code_block_16 = CodeBlock { "Type"; }
setParameterByName = Element.SetParameterByName(element=join, parameterName=code_block_16, value=code_block_14, lacing=CrossProduct)
