# Dynamo graph CreateGrid3D.dyn (Dynamo 2.0.3.8810)

categories = Categories(index=233)  # graph input
all_elements_of_category = ElementsOfCategory(Category=categories)
curve = Grid.Curve(grid=all_elements_of_category)
reverse = Curve.Reverse(curve=curve)
family_types = FamilyTypes(index=1)  # graph input
levels = Levels(index=0)  # graph input
byCurve = Custom[FamilyInstance.ByCurve](curve=reverse, familyType=family_types, level=levels)  # Places a line-based family instance on a given level
string = StringInput("Text")  # graph input
name = Family.Name(family=all_elements_of_category)
setParameterByName = Element.SetParameterByName(element=byCurve, parameterName=string, value=name, lacing=Longest)
