# Dynamo graph Intersect Elements.dyn "Intersection MEP" (Dynamo 2.8.0.2471)

boolean = BoolSelector(true)
python_script = Python(IN[0]=boolean)  # IronPython2
# ---------- python_script.python (2 lines) ----------
f = open("C:\\Users\\NGUYEN NGOC DUE\\OneDrive\\03_DYNAMO\\DYNAMO_TRAINING API NND\\2. WORKING\\Code Python Import Into Dyn\\test.py","r")
OUT = f.read()
# ----------------------------------------
select_model_elements = DSModelElementsSelection()  # 2 picked in the model
generateList = Python(IN[1]=select_model_elements)  # IronPython2; unwired: IN[0]
# ---------- generateList.python (15 lines) ----------
"""Copyright(c) 2019 by: duengocnguyen@gmail.com"""
'https://www.youtube.com/channel/UCt2JhCDDFxpYho575WTMZ4g'
"""________________Welcome to BIM3DM-DYNAMO API___________________"""

def generateList(item):
    if isinstance(item, list):
        return item
    else:
        return [item]
        
        



OUT = generateList(IN[1])
# ----------------------------------------
getGeoElement = Python(IN[1]=generateList)  # IronPython2; unwired: IN[0]
# ---------- getGeoElement.python (46 lines) ----------
"""Copyright(c) 2019 by: duengocnguyen@gmail.com"""
'https://www.youtube.com/channel/UCt2JhCDDFxpYho575WTMZ4g'
"""________________Welcome to BIM3DM-DYNAMO API___________________"""
import clr 
import sys
sys.path.append(r'C:\Program Files\Autodesk\Revit 2020\AddIns\DynamoForRevit\IronPython.StdLib.2.7.8')
import math 
from System.Collections.Generic import *

clr.AddReference("ProtoGeometry")
from Autodesk.DesignScript.Geometry import *

clr.AddReference('RevitAPI')
import Autodesk
from Autodesk.Revit.DB import *

clr.AddReference('RevitAPIUI')
from Autodesk.Revit.UI import*
from  Autodesk.Revit.UI.Selection import*

clr.AddReference("RevitNodes")
import Revit
clr.ImportExtensions(Revit.Elements)
clr.ImportExtensions(Revit.GeometryConversion)

clr.AddReference("RevitServices")
import RevitServices
from RevitServices.Persistence import DocumentManager
from RevitServices.Transactions import TransactionManager

doc = DocumentManager.Instance.CurrentDBDocument
view = doc.ActiveView
uidoc = DocumentManager.Instance.CurrentUIApplication.ActiveUIDocument

def GetGeoElement(element): # Get geometry of element.
    geo = []
    opt = Options()
    opt.ComputeReferences = True
    opt.IncludeNonVisibleObjects = True
    opt.DetailLevel = ViewDetailLevel.Fine
    geoByElement = element.get_Geometry(opt)
    geo = [i for i in geoByElement]
    return geo
ele = UnwrapElement(IN[1])
getGeoFraming = [GetGeoElement(i) for i in ele]
OUT = getGeoFraming
# ----------------------------------------
getSolidFromGeo = Python(IN[1]=getGeoElement)  # IronPython2; unwired: IN[0]
# ---------- getSolidFromGeo.python (49 lines) ----------
"""Copyright(c) 2019 by: duengocnguyen@gmail.com"""
'https://www.youtube.com/channel/UCt2JhCDDFxpYho575WTMZ4g'
"""________________Welcome to BIM3DM-DYNAMO API___________________"""
import clr 
import sys
sys.path.append(r'C:\Program Files\Autodesk\Revit 2020\AddIns\DynamoForRevit\IronPython.StdLib.2.7.8')
import math 
from System.Collections.Generic import *

clr.AddReference("ProtoGeometry")
from Autodesk.DesignScript.Geometry import *

clr.AddReference('RevitAPI')
import Autodesk
from Autodesk.Revit.DB import *

clr.AddReference('RevitAPIUI')
from Autodesk.Revit.UI import*
from  Autodesk.Revit.UI.Selection import*

clr.AddReference("RevitNodes")
import Revit
clr.ImportExtensions(Revit.Elements)
clr.ImportExtensions(Revit.GeometryConversion)

clr.AddReference("RevitServices")
import RevitServices
from RevitServices.Persistence import DocumentManager
from RevitServices.Transactions import TransactionManager

doc = DocumentManager.Instance.CurrentDBDocument
view = doc.ActiveView
uidoc = DocumentManager.Instance.CurrentUIApplication.ActiveUIDocument

def GetSolidFromGeo(lstGeo): # Get Solid from Geo
    sol = []
    for i in lstGeo:
        if i.GetType()== Solid and i.Volume > 0:
            sol.append(i)
        elif i.GetType() == GeometryInstance:
            var = i.SymbolGeometry
            for j in var:
                if j.Volume > 0:
                    sol.append(j)
    return sol
    
ele = IN[1]
getSolidFraming = [GetSolidFromGeo(i) for i in ele]
OUT = getSolidFraming
# ----------------------------------------
python_script_from_string = PythonStringNode(script=python_script, IN[0]=getSolidFromGeo, IN[1]=getSolidFromGeo)  # IronPython2; unwired: IN[2]
getGeometryRevitToDyn = Python(IN[1]=python_script_from_string)  # IronPython2; unwired: IN[0]
# ---------- getGeometryRevitToDyn.python (71 lines) ----------
"""Copyright(c) 2019 by: duengocnguyen@gmail.com"""
'https://www.youtube.com/channel/UCt2JhCDDFxpYho575WTMZ4g'
"""________________Welcome to BIM3DM-DYNAMO API___________________"""
import clr 
import sys
sys.path.append(r'C:\Program Files\Autodesk\Revit 2020\AddIns\DynamoForRevit\IronPython.StdLib.2.7.8')
import math 
from System.Collections.Generic import *

clr.AddReference("ProtoGeometry")
from Autodesk.DesignScript.Geometry import *

clr.AddReference('RevitAPI')
import Autodesk
from Autodesk.Revit.DB import *

clr.AddReference('RevitAPIUI')
from Autodesk.Revit.UI import*
from  Autodesk.Revit.UI.Selection import*

clr.AddReference("RevitNodes")
import Revit
clr.ImportExtensions(Revit.Elements)
clr.ImportExtensions(Revit.GeometryConversion)

clr.AddReference("RevitServices")
import RevitServices
from RevitServices.Persistence import DocumentManager
from RevitServices.Transactions import TransactionManager

doc = DocumentManager.Instance.CurrentDBDocument
view = doc.ActiveView
uidoc = DocumentManager.Instance.CurrentUIApplication.ActiveUIDocument

def listRank(item):
	level = 0
	if isinstance (item, list):
		level += 1
		if isinstance (item[0], list):
			for i in item[0]:
				level += 1
				if isinstance(i, list):
					level += 1
					if isinstance(i[0], list):
						level += 1
						if isinstance(i[0][0], list):
							level += 1
						else:
							return level
					else:
						return level	
				else:
					return level
		else:
			return level
	else:
		return level
	return level

def getGeometryRevitToDyn(item):
	levelLst = listRank(item)
	if (levelLst == 1):
		return [i.ToProtoType() for i in item]
	elif levelLst == 2:
		return [j.ToProtoType() for i in item for j in i]
	elif levelLst == 3:
		return [t.ToProtoType() for i in item for j in i for t in j]
	else:
		return item.ToProtoType()
item = IN[1]
OUT = getGeometryRevitToDyn(item)
# ----------------------------------------
python_script_2 = Python(IN[0]=getGeometryRevitToDyn)  # IronPython2
# ---------- python_script_2.python (46 lines) ----------
"""Copyright(c) 2019 by: duengocnguyen@gmail.com"""
'https://www.youtube.com/channel/UCt2JhCDDFxpYho575WTMZ4g'
"""________________Welcome to BIM3DM-DYNAMO API___________________"""
import clr 
import sys
sys.path.append(r'C:\Program Files\Autodesk\Revit 2020\AddIns\DynamoForRevit\IronPython.StdLib.2.7.8')
import math 
from System.Collections.Generic import *

clr.AddReference("ProtoGeometry")
from Autodesk.DesignScript.Geometry import *

clr.AddReference('RevitAPI')
import Autodesk
from Autodesk.Revit.DB import *

clr.AddReference('RevitAPIUI')
from Autodesk.Revit.UI import*
from  Autodesk.Revit.UI.Selection import*

clr.AddReference("RevitNodes")
import Revit
clr.ImportExtensions(Revit.Elements)
clr.ImportExtensions(Revit.GeometryConversion)

clr.AddReference("RevitServices")
import RevitServices
from RevitServices.Persistence import DocumentManager
from RevitServices.Transactions import TransactionManager

doc = DocumentManager.Instance.CurrentDBDocument
view = doc.ActiveView
uidoc = DocumentManager.Instance.CurrentUIApplication.ActiveUIDocument

#Preparing input from dynamo to revit
element = UnwrapElement(IN[0])

#Do some action in a Transaction
#TransactionManager.Instance.EnsureInTransaction(doc)
"""Now, You Can Code """



#TransactionManager.Instance.TransactionTaskDone()

OUT = [i  for i in element if i != None ]
# ----------------------------------------
code_block = CodeBlock(a=python_script_2) { a.Volume; }
getGeometryRevitToDyn_2 = Python(IN[1]=getSolidFromGeo)  # IronPython2; unwired: IN[0]; same code as getGeometryRevitToDyn
code_block_2 = CodeBlock(a=python_script_2) { a[1]; }
python_script_3 = Python(IN[0]=code_block_2)  # IronPython2
# ---------- python_script_3.python (46 lines) ----------
"""Copyright(c) 2019 by: duengocnguyen@gmail.com"""
'https://www.youtube.com/channel/UCt2JhCDDFxpYho575WTMZ4g'
"""________________Welcome to BIM3DM-DYNAMO API___________________"""
import clr 
import sys
sys.path.append(r'C:\Program Files\Autodesk\Revit 2020\AddIns\DynamoForRevit\IronPython.StdLib.2.7.8')
import math 
from System.Collections.Generic import *

clr.AddReference("ProtoGeometry")
from Autodesk.DesignScript.Geometry import *

clr.AddReference('RevitAPI')
import Autodesk
from Autodesk.Revit.DB import *

clr.AddReference('RevitAPIUI')
from Autodesk.Revit.UI import*
from  Autodesk.Revit.UI.Selection import*

clr.AddReference("RevitNodes")
import Revit
clr.ImportExtensions(Revit.Elements)
clr.ImportExtensions(Revit.GeometryConversion)

clr.AddReference("RevitServices")
import RevitServices
from RevitServices.Persistence import DocumentManager
from RevitServices.Transactions import TransactionManager

doc = DocumentManager.Instance.CurrentDBDocument
view = doc.ActiveView
uidoc = DocumentManager.Instance.CurrentUIApplication.ActiveUIDocument

#Preparing input from dynamo to revit
element = UnwrapElement(IN[0])

#Do some action in a Transaction
#TransactionManager.Instance.EnsureInTransaction(doc)
"""Now, You Can Code """



#TransactionManager.Instance.TransactionTaskDone()

OUT = element.Centroid()
# ----------------------------------------
intersectAll = Geometry.IntersectAll()  # unwired: geometry, others
code_block_3 = CodeBlock()
# ---------- code_block_3.designscript (45 lines) ----------
"""Copyright(c) 2019 by: duengocnguyen@gmail.com"""
'https://www.youtube.com/channel/UCt2JhCDDFxpYho575WTMZ4g'
"""________________Welcome to BIM3DM-DYNAMO API___________________"""
import clr
import sys
sys.path.append(r'C:\Program Files\Autodesk\Revit 2020\AddIns\DynamoForRevit\IronPython.StdLib.2.7.8')
import math
from System.Collections.Generic import *

clr.AddReference("ProtoGeometry")
from Autodesk.DesignScript.Geometry import *

clr.AddReference('RevitAPI')
import Autodesk
from Autodesk.Revit.DB import *

clr.AddReference('RevitAPIUI')
from Autodesk.Revit.UI import*
from  Autodesk.Revit.UI.Selection import*

clr.AddReference("RevitNodes")
import Revit
clr.ImportExtensions(Revit.Elements)
clr.ImportExtensions(Revit.GeometryConversion)

clr.AddReference("RevitServices")
import RevitServices
from RevitServices.Persistence import DocumentManager
from RevitServices.Transactions import TransactionManager



def lstFlattenL2(list): #List.Flatten
    result = []
    for i in list:
        for j in i:
            result.append(j)
    return result
#----------------------------------------------------------------
ele1 = lstFlattenL2(IN[1])
re = []
for i in ele1:
    itemIntersec = BooleanOperationsUtils.ExecuteBooleanOperation(ele1[0],i,BooleanOperationsType.Union)
    re.append(itemIntersec)
OUT = re;
# ----------------------------------------
code_block_4 = CodeBlock()
# ---------- code_block_4.designscript (2 lines) ----------
1. Edit path of your python file (.py)
2. Copy all content of the code block node to your python (.py);
# ----------------------------------------
