# Dynamo graph Slope.dyn (Dynamo 2.3.0.5885)

select_edges_elements = Python()  # graph input
# ---------- select_edges_elements.python (38 lines) ----------
import clr 

clr.AddReference("RevitAPIUI")
from  Autodesk.Revit.UI import *

clr.AddReference("RevitServices")
import RevitServices
from RevitServices.Persistence import DocumentManager
doc = DocumentManager.Instance.CurrentDBDocument
uidoc=DocumentManager.Instance.CurrentUIApplication.ActiveUIDocument
    
clr.AddReference("RevitNodes")
import Revit
clr.ImportExtensions(Revit.Elements)
clr.ImportExtensions(Revit.GeometryConversion)
 

obType = Selection.ObjectType.Element
list = uidoc.Selection.PickObjects(obType, "🐶🐶🐶 Please!!!Seclect Elemnets of 1111 to 2222.🐶🐶🐶🐶 ")
result = []
for ref in list:
	element = doc.GetElement(ref.ElementId)
	result.Add(element.ToDSType(True))	
	



sel1 = uidoc.Selection
ot1 = Selection.ObjectType.Edge
refs = sel1.PickObjects(ot1, "Select Edges of Element 11111111")
edges = []
for i in xrange(len(refs)):
	el1 = doc.GetElement(refs[i].ElementId)
	edge = el1.GetGeometryObjectFromReference(refs[i])
	edges.append(edge.AsCurve().ToProtoType())
	
	 
OUT = result,edges
# ----------------------------------------
code_block = CodeBlock(element=select_edges_elements) { element[0]; }
code_block_2 = CodeBlock(a=code_block) { a[0]; a[1]; a[2]; }
code_block_3 = CodeBlock { "Cross-Section Rotation"; }
sign = StringInput("-")  # graph input
code_block_4 = CodeBlock(edge=select_edges_elements) { edge[1]; }
code_block_5 = CodeBlock { 2; }
chop = List.Chop(list=code_block_4, lengths=code_block_5)
code_block_6 = CodeBlock(edges=chop) { edges[0]; edges[1]; edges[2]; }
code_block_7 = CodeBlock(a=code_block_6.out0) { a[0]; a[1]; }
startPoint = Curve.StartPoint(curve=code_block_7.out1)
endPoint = Curve.EndPoint(curve=code_block_7.out1)
byTwoPoints = Vector.ByTwoPoints(start=startPoint, end=endPoint)
startPoint_2 = Curve.StartPoint(curve=code_block_7.out0)
endPoint_2 = Curve.EndPoint(curve=code_block_7.out0)
byTwoPoints_2 = Vector.ByTwoPoints(start=startPoint_2, end=endPoint_2)
angleWithVector = Vector.AngleWithVector(vector=byTwoPoints, otherVector=byTwoPoints_2)  # graph output
code_block_8 = CodeBlock(b=sign, a=angleWithVector) { b+a; }
toNumber = String.ToNumber(str=code_block_8)
setParameterByName = Element.SetParameterByName(element=code_block_2.out0, parameterName=code_block_3, value=toNumber)  # graph output
code_block_9 = CodeBlock { "Cross-Section Rotation"; }
code_block_10 = CodeBlock(a=code_block_6.out1) { a[0]; a[1]; }
startPoint_3 = Curve.StartPoint(curve=code_block_10.out1)
endPoint_3 = Curve.EndPoint(curve=code_block_10.out1)
byTwoPoints_3 = Vector.ByTwoPoints(start=startPoint_3, end=endPoint_3)
startPoint_4 = Curve.StartPoint(curve=code_block_10.out0)
endPoint_4 = Curve.EndPoint(curve=code_block_10.out0)
byTwoPoints_4 = Vector.ByTwoPoints(start=startPoint_4, end=endPoint_4)
angleWithVector_2 = Vector.AngleWithVector(vector=byTwoPoints_3, otherVector=byTwoPoints_4)  # graph output
code_block_11 = CodeBlock(b=sign, a=angleWithVector_2) { b+a; }
toNumber_2 = String.ToNumber(str=code_block_11)
setParameterByName_2 = Element.SetParameterByName(element=code_block_2.out1, parameterName=code_block_9, value=toNumber_2)  # graph output
code_block_12 = CodeBlock { "Cross-Section Rotation"; }
code_block_13 = CodeBlock(a=code_block_6.out2) { a[0]; a[1]; }
startPoint_5 = Curve.StartPoint(curve=code_block_13.out1)
endPoint_5 = Curve.EndPoint(curve=code_block_13.out1)
byTwoPoints_5 = Vector.ByTwoPoints(start=startPoint_5, end=endPoint_5)
startPoint_6 = Curve.StartPoint(curve=code_block_13.out0)
endPoint_6 = Curve.EndPoint(curve=code_block_13.out0)
byTwoPoints_6 = Vector.ByTwoPoints(start=startPoint_6, end=endPoint_6)
angleWithVector_3 = Vector.AngleWithVector(vector=byTwoPoints_5, otherVector=byTwoPoints_6)  # graph output
code_block_14 = CodeBlock(b=sign, a=angleWithVector_3) { b+a; }
toNumber_3 = String.ToNumber(str=code_block_14)
setParameterByName_3 = Element.SetParameterByName(element=code_block_2.out2, parameterName=code_block_12, value=toNumber_3)  # graph output
