# Dynamo graph CreateSheet.dyn (Dynamo 2.3.0.5885)

file_path = Filename("..\..\..\..\..\..\Desktop\Sheet\Sheet.csv")  # graph input; frozen
file_from_path = FileObject(path=file_path)
code_block = CodeBlock { "Sheet"; }
code_block_2 = CodeBlock { false; }
importExcel = Data.ImportExcel(file=file_from_path, sheetName=code_block, showExcel=code_block_2)
dropItems = Python(IN[0]=importExcel)  # "List.DropItems"
# ---------- dropItems.python (4 lines) ----------
value = IN[0][1::]
infor = IN[0][0:1:]

OUT = value , infor
# ----------------------------------------
code_block_3 = CodeBlock(infor=dropItems, value=dropItems) { infor[1]; value[0]; }
transpose = List.Transpose(lists=code_block_3.out1)
code_block_4 = CodeBlock(stt=transpose, SheetNumber=transpose, SheetName=transpose, TitleBlock=transpose) { stt[0]; SheetNumber[1]; SheetName[2]; TitleBlock[3]; }
byName = FamilyType.ByName(name=code_block_4.out3)
refesh = BoolSelector(true)  # graph input
python_script = Python(IN[1]=code_block_4.out1, IN[2]=byName, IN[3]=refesh)  # unwired: IN[0]
# ---------- python_script.python (57 lines) ----------
"""Copyright(c) 2019 by: duengocnguyen@gmail.com"""
__doc__ = '.........'
__author__ = 'https://www.youtube.com/channel/UCt2JhCDDFxpYho575WTMZ4g'
__title__ = '.....'
"""________________Welcome to BIM3DM-DYNAMO API___________________"""
import clr 
import sys
sys.path.append(r'C:\Program Files\Autodesk\Revit 2020\AddIns\DynamoForRevit\IronPython.StdLib.2.7.8')
import math 
from System.Collections.Generic import *

clr.AddReference("ProtoGeometry")
from Autodesk.DesignScript.Geometry import *

clr.AddReference('RevitAPI')
import Autodesk
from Autodesk.Revit.DB import *

clr.AddReference('RevitAPIUI')
from Autodesk.Revit.UI import*
from  Autodesk.Revit.UI.Selection import*

clr.AddReference("RevitNodes")
import Revit
clr.ImportExtensions(Revit.Elements)
clr.ImportExtensions(Revit.GeometryConversion)

clr.AddReference("RevitServices")
import RevitServices
from RevitServices.Persistence import DocumentManager
from RevitServices.Transactions import TransactionManager

doc = DocumentManager.Instance.CurrentDBDocument
view = doc.ActiveView
uidoc = DocumentManager.Instance.CurrentUIApplication.ActiveUIDocument

sheetnames = IN[0]
sheetNumber = IN[1]
titleblock = UnwrapElement(IN[2])
sheetlist = list()


TransactionManager.Instance.EnsureInTransaction(doc)
idTitleB = []
for number,title in zip(range(len(sheetnames)),titleblock):
	try:
  		newsheet = ViewSheet.Create(doc,title.Id)
  		idTitle = idTitleB.append(newsheet)
  		newsheet.Name = sheetnames[number]
  		newsheet.SheetNumber = sheetNumber[number]
  		sheetlist.append(newsheet.ToDSType(False))
  	except:
  		"None"

TransactionManager.Instance.TransactionTaskDone()

OUT = idTitleB
# ----------------------------------------

# group: Crete Template Excel
refesh_2 = BoolSelector(true)  # graph input
crete_template_excel = Python(IN[0]=refesh_2)
# ---------- crete_template_excel.python (21 lines) ----------
import os

'''New Folder'''
##########################################################################
path = r'C:\Users\NGUYEN NGOC DUE\\Desktop\Sheet'
if not os.path.exists(path):
    os.makedirs(path)
    
    
'''NewExcel File'''
##########################################################################
createFile = open(r'C:\Users\NGUYEN NGOC DUE\Desktop\Sheet\Sheet.csv',"w")
createFile.close()

import csv
with open (r'C:\Users\NGUYEN NGOC DUE\Desktop\Sheet\Sheet.csv','w+') as f:
    write = csv.writer(f)
    #write.writerow(['Create Sheet From Excel File'])
    write.writerow(['NO.i','Sheet Number','Sheet Name','Title Block'])
    #write.writerow([1,'A101','Your Sheet Name:Sheet one_1','Your Family Title'])
	  
# ----------------------------------------

file_path_2 = Filename("..\..\..\..\..\..\Desktop\Sheet\Sheet.csv")  # graph input; frozen
file_from_path_2 = FileObject(path=file_path_2)
code_block_5 = CodeBlock { "Sheet"; }
code_block_6 = CodeBlock { false; }
importExcel_2 = Data.ImportExcel(file=file_from_path_2, sheetName=code_block_5, showExcel=code_block_6)
dropItems_2 = Python(IN[0]=importExcel_2)  # "List.DropItems"
# ---------- dropItems_2.python (4 lines) ----------
list1 = IN[0][2::]
list2 = IN[0][1:2:]

OUT = list1 , list2
# ----------------------------------------
code_block_7 = CodeBlock(infor=dropItems_2, value=dropItems_2) { infor[1]; value[0]; }
transpose_2 = List.Transpose(lists=code_block_7.out1)
code_block_8 = CodeBlock(stt=transpose_2, SheetNumber=transpose_2, SheetName=transpose_2, TitleBlock=transpose_2) { stt[0]; SheetNumber[1]; SheetName[2]; TitleBlock[3]; }
byName_2 = FamilyType.ByName(name=code_block_8.out3)
refesh_3 = BoolSelector(false)  # graph input
python_script_2 = Python(IN[0]=code_block_8.out2, IN[1]=code_block_8.out1, IN[2]=byName_2, IN[3]=refesh_3)  # same code as python_script
