# Dynamo graph Fix2_Onlyone_CreateFramingByIfc_MethodByEdges_Python.dyn (Dynamo 2.3.0.5885)
# packages: Spring - Dynamo 2.0 0.0.3

select_edges = Python()  # graph input
# ---------- select_edges.python (79 lines) ----------
import clr 

clr.AddReference("RevitAPIUI")
from  Autodesk.Revit.UI import *

clr.AddReference("RevitServices")
import RevitServices
from RevitServices.Persistence import DocumentManager
doc = DocumentManager.Instance.CurrentDBDocument
uidoc=DocumentManager.Instance.CurrentUIApplication.ActiveUIDocument
  
clr.AddReference("RevitNodes")
import Revit
clr.ImportExtensions(Revit.Elements)
clr.ImportExtensions(Revit.GeometryConversion)


obType = Selection.ObjectType.Element
list = uidoc.Selection.PickObjects(obType, "🐶🐶🐶 Please!!!Seclect Elemnets of 1111 to 5555.🐶🐶🐶🐶 ")
result = []
for ref in list:
	element = doc.GetElement(ref.ElementId)
	result.Add(element.ToDSType(True))	
	



sel1 = uidoc.Selection
ot1 = Selection.ObjectType.Edge
refs = sel1.PickObjects(ot1, "Select Edges of Element 1111")
edges = []
for i in xrange(len(refs)):
	el1 = doc.GetElement(refs[i].ElementId)
	edge = el1.GetGeometryObjectFromReference(refs[i])
	edges.append(edge.AsCurve().ToProtoType())
	
sel2 = uidoc.Selection
ot2 = Selection.ObjectType.Edge
refs2 = sel2.PickObjects(ot2, "Select Edges of Element 2222")
edges2 = []
for j in xrange(len(refs2)):
	el2 = doc.GetElement(refs2[j].ElementId)
	edge2 = el2.GetGeometryObjectFromReference(refs2[j])
	edges2.append(edge2.AsCurve().ToProtoType())

sel3 = uidoc.Selection
ot3 = Selection.ObjectType.Edge
refs3 = sel3.PickObjects(ot3, "Select Edges of Element 3333")
edges3 = []
for j in xrange(len(refs3)):
	el3 = doc.GetElement(refs3[j].ElementId)
	edge3 = el3.GetGeometryObjectFromReference(refs3[j])
	edges3.append(edge3.AsCurve().ToProtoType())
	
	
	
sel4 = uidoc.Selection
ot4 = Selection.ObjectType.Edge
refs4 = sel4.PickObjects(ot4, "Select Edges of Element 4444")
edges4 = []
for j in xrange(len(refs4)):
    el4 = doc.GetElement(refs4[j].ElementId)
    edge4 = el4.GetGeometryObjectFromReference(refs4[j])
    edges4.append(edge4.AsCurve().ToProtoType())
	
	
sel5 = uidoc.Selection
ot5 = Selection.ObjectType.Edge
refs5 = sel5.PickObjects(ot5, "Select Edges of Element 55555")
edges5 = []
for j in xrange(len(refs5)):
    el5 = doc.GetElement(refs5[j].ElementId)
    edge5 = el5.GetGeometryObjectFromReference(refs5[j])
    edges5.append(edge5.AsCurve().ToProtoType())

	
	
	 
OUT = edges,result,edges2,edges3,edges4,edges5
# ----------------------------------------
code_block = CodeBlock(line=select_edges) { line[2]; }
code_block_2 = CodeBlock(a=code_block) { a[0]; }
code_block_3 = CodeBlock(a=code_block) { a[1]; }
middleLineBy2Lines = Geometry.Curves.MiddleLineBy2Lines(line1=code_block_2, line2=code_block_3)
levels = Levels("1FL")  # graph input
code_block_4 = CodeBlock(Strucframing=select_edges) { Strucframing[1]; }
string_from_object = FromObject(obj=code_block_4)
byName = FamilyType.ByName(name=string_from_object)  # graph output
code_block_5 = CodeBlock(element=byName) { element[0]; element[1]; element[2]; element[3]; element[4]; }
beamByCurve = StructuralFraming.BeamByCurve(curve=middleLineBy2Lines, level=levels, structuralFramingType=code_block_5.out1)  # graph output
code_block_6 = CodeBlock(line=select_edges) { line[0]; }
code_block_7 = CodeBlock(a=code_block_6) { a[0]; }
code_block_8 = CodeBlock(a=code_block_6) { a[1]; }
middleLineBy2Lines_2 = Geometry.Curves.MiddleLineBy2Lines(line1=code_block_7, line2=code_block_8)
beamByCurve_2 = StructuralFraming.BeamByCurve(curve=middleLineBy2Lines_2, level=levels, structuralFramingType=code_block_5.out0)  # graph output
code_block_9 = CodeBlock(line=select_edges) { line[3]; }
code_block_10 = CodeBlock(a=code_block_9) { a[0]; }
code_block_11 = CodeBlock(a=code_block_9) { a[1]; }
middleLineBy2Lines_3 = Geometry.Curves.MiddleLineBy2Lines(line1=code_block_10, line2=code_block_11)
beamByCurve_3 = StructuralFraming.BeamByCurve(curve=middleLineBy2Lines_3, level=levels, structuralFramingType=code_block_5.out2)  # graph output
code_block_12 = CodeBlock(line=select_edges) { line[4]; }
code_block_13 = CodeBlock(a=code_block_12) { a[0]; }
code_block_14 = CodeBlock(a=code_block_12) { a[1]; }
middleLineBy2Lines_4 = Geometry.Curves.MiddleLineBy2Lines(line1=code_block_13, line2=code_block_14)
beamByCurve_4 = StructuralFraming.BeamByCurve(curve=middleLineBy2Lines_4, level=levels, structuralFramingType=code_block_5.out3)  # graph output
code_block_15 = CodeBlock(line=select_edges) { line[5]; }
code_block_16 = CodeBlock(a=code_block_15) { a[0]; }
code_block_17 = CodeBlock(a=code_block_15) { a[1]; }
middleLineBy2Lines_5 = Geometry.Curves.MiddleLineBy2Lines(line1=code_block_16, line2=code_block_17)
beamByCurve_5 = StructuralFraming.BeamByCurve(curve=middleLineBy2Lines_5, level=levels, structuralFramingType=code_block_5.out4)  # graph output
