# Dynamo graph Pipes_Connection_AxisY_byFace.dyn (Dynamo 2.0.3.8810)

select_model_element = DSModelElementSelection()  # 1 picked in the model; graph input
connectors = Custom[Element.Connectors](Element=select_model_element)  # Returns every connector on an element (also return connectors of a System)
isConnected = Custom[Connector.IsConnected](connector=connectors)  # Returns a boolean indicating whether the connector is connected to a connector on different element
filterByBoolMask = List.FilterByBoolMask(list=connectors, mask=isConnected)
flatten = List.Flatten(list=filterByBoolMask.out)
select_face = DSFaceSelection()  # 1 picked in the model; graph input

# group: Connection Yes/Not_Intersection_with_surface
location = Custom[Connector.Location](connector=flatten)  # Returns the location of a connector
doesIntersect = Geometry.DoesIntersect(geometry=location, other=select_face, lacing=CrossProduct)
code_block = CodeBlock(a=doesIntersect) { List.Flatten(a); }
filterByBoolMask_2 = List.FilterByBoolMask(list=flatten, mask=code_block)
code_block_2 = CodeBlock(Connection_Intersection_with_surface=filterByBoolMask_2.in, Not_Connection_Intersection_with_surface=filterByBoolMask_2.out) { Connection_Intersection_with_surface; Not_Connection_Intersection_with_surface; }
location_2 = Python(IN[0]=code_block_2.Connection_Intersection_with_surface)  # "Connector.Location"
# ---------- location_2.python (41 lines) ----------
import clr

clr.AddReference("RevitServices")
import RevitServices
from RevitServices.Persistence import DocumentManager
from RevitServices.Transactions import TransactionManager
doc = DocumentManager.Instance.CurrentDBDocument

clr.AddReference("RevitAPI")
import Autodesk
from Autodesk.Revit.DB import *

clr.AddReference("RevitNodes")
import Revit
clr.ImportExtensions(Revit.Elements)
clr.ImportExtensions(Revit.GeometryConversion)

#Many thanks to Konrad K Sobon for his awesome ProcessList function!
def Unwrap(item):
	return UnwrapElement(item)

def ProcessList(_func, _list):
    return map( lambda x: ProcessList(_func, x) if type(x)==list else _func(x), _list )

if isinstance(IN[0], list):
	connectors = ProcessList(Unwrap, IN[0])
else:
	connectors = [Unwrap(IN[0])]
	
	
def getPoint(connector):
	try:
		return connector.Origin.ToPoint()
	except:
		return None


			
#Assign your output to the OUT variable.

OUT = ProcessList(getPoint, connectors)
# ----------------------------------------

code_block_3 = CodeBlock { Vector.ByCoordinates(0,0,1); }
getLocation = Element.GetLocation(element=select_model_element)
direction = Line.Direction(line=getLocation)
pipe_rotate = DoubleSlider(280, range=-360..360 step 0.1)  # graph input
rotate = Vector.Rotate(vector=code_block_3, axis=direction, degrees=pipe_rotate)
length_pipes = DoubleInput(1000)  # graph input
byStartPointDirectionLength = Line.ByStartPointDirectionLength(startPoint=location_2, direction=rotate, length=length_pipes)
startPoint = Curve.StartPoint(curve=byStartPointDirectionLength)
python_script_connector = Python(IN[0]=code_block_2.Connection_Intersection_with_surface)  # "Python Script_Connector.Direction_BasisY"
# ---------- python_script_connector.python (41 lines) ----------
import clr

clr.AddReference("RevitServices")
import RevitServices
from RevitServices.Persistence import DocumentManager
from RevitServices.Transactions import TransactionManager
doc = DocumentManager.Instance.CurrentDBDocument

clr.AddReference("RevitAPI")
import Autodesk
from Autodesk.Revit.DB import *

clr.AddReference("RevitNodes")
import Revit
clr.ImportExtensions(Revit.Elements)
clr.ImportExtensions(Revit.GeometryConversion)

#Many thanks to Konrad K Sobon for his awesome ProcessList function!
def Unwrap(item):
	return UnwrapElement(item)

def ProcessList(_func, _list):
    return map( lambda x: ProcessList(_func, x) if type(x)==list else _func(x), _list )

if isinstance(IN[0], list):
	connectors = ProcessList(Unwrap, IN[0])
else:
	connectors = [Unwrap(IN[0])]
	
	
def getConnDir(connector):
	try:
		return connector.CoordinateSystem.BasisY.ToVector()
	except:
		return None


			
#Assign your output to the OUT variable.

OUT = ProcessList(getConnDir, connectors)
# ----------------------------------------
code_block_4 = CodeBlock(MEPMainCurve=code_block_2.Connection_Intersection_with_surface) { MEPMainCurve; }
endPoint = Curve.EndPoint(curve=byStartPointDirectionLength)
element_types = ElementTypes(index=236)
all_elements_of_type = ElementsOfType(element_type=element_types)
number_slider = DoubleSlider(0, range=0..100 step 0.1)
getItemAtIndex = List.GetItemAtIndex(list=all_elements_of_type, index=number_slider)

# group: Element.GetParameterValueByName
code_block_5 = CodeBlock { "Reference Level"; }
getParameterValueByName = Element.GetParameterValueByName(element=select_model_element, parameterName=code_block_5)

code_block_6 = CodeBlock(connector=code_block_2.Connection_Intersection_with_surface, point=endPoint, pipetype=getItemAtIndex, level=getParameterValueByName) { connector; point; pipetype; level; }
python_script = Python(IN[0]=code_block_6.connector, IN[1]=code_block_6.point, IN[2]=code_block_6.pipetype, IN[3]=code_block_6.level)
# ---------- python_script.python (54 lines) ----------
import clr

clr.AddReference("RevitServices")
import RevitServices
from RevitServices.Persistence import DocumentManager
from RevitServices.Transactions import TransactionManager
doc = DocumentManager.Instance.CurrentDBDocument

clr.AddReference("RevitAPI")
import Autodesk
from Autodesk.Revit.DB import *

clr.AddReference("RevitNodes")
import Revit
clr.ImportExtensions(Revit.Elements)
clr.ImportExtensions(Revit.GeometryConversion)

toggle = 0

if isinstance(IN[0], list):
	connector1 = IN[0]
else:
	connector1 = [IN[0]]
	toggle = 1
if isinstance(IN[1], list):
	point = IN[1]
else:
	point = [IN[1]]
pipetype = UnwrapElement(IN[2])
if isinstance(IN[3], list):
	level = UnwrapElement(IN[3])
else:
	level = [UnwrapElement(IN[3])]
ll = len(level)


elements = []

TransactionManager.Instance.EnsureInTransaction(doc)
for i,conn1 in enumerate(connector1):
	try:
		levelid = level[i%ll].Id
		pipe = Autodesk.Revit.DB.Plumbing.Pipe.Create(doc,pipetype.Id,levelid,conn1,point[i].ToXyz())
	
		elements.append(pipe.ToDSType(False))
	except:
		elements.append(None)

TransactionManager.Instance.TransactionTaskDone()

if toggle:
	OUT = elements[0]
else:
	OUT = elements
# ----------------------------------------
byMEPCurves = Python(IN[0]=code_block_4, IN[1]=python_script)  # "MEPover_MEPFitting.ByMEPCurves"
# ---------- byMEPCurves.python (72 lines) ----------
import clr

clr.AddReference("RevitServices")
import RevitServices
from RevitServices.Persistence import DocumentManager
from RevitServices.Transactions import TransactionManager
doc = DocumentManager.Instance.CurrentDBDocument

clr.AddReference("RevitAPI")
from Autodesk.Revit.DB import *

clr.AddReference("RevitNodes")
import Revit
clr.ImportExtensions(Revit.Elements)
clr.ImportExtensions(Revit.GeometryConversion)

if isinstance(IN[0], list):
	pipe1 = UnwrapElement(IN[0])
else:
	pipe1 = [UnwrapElement(IN[0])]
if isinstance(IN[1], list):
	pipe2 = UnwrapElement(IN[1])
else:
	pipe2 = [UnwrapElement(IN[1])]

def closest_connectors(pipe1, pipe2):
	conn1 = pipe1.ConnectorManager.Connectors
	conn2 = pipe2.ConnectorManager.Connectors
	
	dist = 100000000
	connset = None
	for c in conn1:
		for d in conn2:
			conndist = c.Origin.DistanceTo(d.Origin)
			if conndist < dist:
				dist = conndist
				connset = [c,d]
	return connset

	
def check_dir(conn1,conn2):
	if conn1.CoordinateSystem.BasisZ.ToString() == conn2.CoordinateSystem.BasisZ.ToString() or conn1.CoordinateSystem.BasisZ.ToString() == (conn2.CoordinateSystem.BasisZ*-1).ToString():
		return True
	else:
		return False
	
fittings = []

for p1,p2 in zip(pipe1,pipe2):
	connectors = closest_connectors(p1,p2)
	
	if check_dir(connectors[0],connectors[1]):
		TransactionManager.Instance.EnsureInTransaction(doc)
		
		fitting = doc.Create.NewUnionFitting(connectors[0],connectors[1])
		try:
			fittings.append(fitting.ToDSType(False))
		except:
			fittings.append("fitting not created by Dynamo")
		
		TransactionManager.Instance.TransactionTaskDone()
	else:
		TransactionManager.Instance.EnsureInTransaction(doc)
	
		fitting = doc.Create.NewElbowFitting(connectors[0],connectors[1])
		fittings.append(fitting.ToDSType(False))
		
		TransactionManager.Instance.TransactionTaskDone()

			

OUT = fittings
# ----------------------------------------
