# Dynamo graph Point Cloud Pipes_Connection_OK.dyn "Point Cloud Pipes_Connection_Repair" (Dynamo 2.0.3.8810)

select_model_element = DSModelElementSelection()  # 1 picked in the model; graph input
connectors = Custom[Element.Connectors](Element=select_model_element)  # Returns every connector on an element (also return connectors of a System)
isConnected = Custom[Connector.IsConnected](connector=connectors)  # Returns a boolean indicating whether the connector is connected to a connector on different element
filterByBoolMask = List.FilterByBoolMask(list=connectors, mask=isConnected)
flatten = List.Flatten(list=filterByBoolMask.out)
code_block = CodeBlock(MEPMainCurve=flatten) { MEPMainCurve; }
code_block_2 = CodeBlock(a=flatten) { a[1]; }
select_face = DSFaceSelection()  # 1 picked in the model; graph input

# group: Connection Yes/Not_Intersection_with_surface
location = Custom[Connector.Location](connector=flatten)  # Returns the location of a connector
doesIntersect = Geometry.DoesIntersect(geometry=location, other=select_face, lacing=CrossProduct)
code_block_3 = CodeBlock(a=doesIntersect) { List.Flatten(a); }
filterByBoolMask_2 = List.FilterByBoolMask(list=flatten, mask=code_block_3)
code_block_4 = CodeBlock(Connection_Intersection_with_surface=filterByBoolMask_2.in, Not_Connection_Intersection_with_surface=filterByBoolMask_2.out) { Connection_Intersection_with_surface; Not_Connection_Intersection_with_surface; }

location_2 = Custom[Connector.Location](connector=code_block_4.Connection_Intersection_with_surface)
direction_BasisX = Custom[Connector.Direction_BasisX](connector=code_block_2)  # Returns the direction (X value) of the CoordinateSystem of the Connector
getLocation = Element.GetLocation(element=select_model_element)
direction = Line.Direction(line=getLocation)
pipe_rotate = DoubleSlider(0, range=0..100 step 0.1)
rotate = Vector.Rotate(vector=direction_BasisX, axis=direction, degrees=pipe_rotate)
length_pipes = DoubleInput(1000)
byStartPointDirectionLength = Line.ByStartPointDirectionLength(startPoint=location_2, direction=rotate, length=length_pipes)
endPoint = Curve.EndPoint(curve=byStartPointDirectionLength)
element_types = ElementTypes(index=236)
all_elements_of_type = ElementsOfType(element_type=element_types)
number_slider = DoubleSlider(0, range=0..100 step 0.1)
getItemAtIndex = List.GetItemAtIndex(list=all_elements_of_type, index=number_slider)
code_block_5 = CodeBlock { "Reference Level"; }
getParameterValueByName = Element.GetParameterValueByName(element=select_model_element, parameterName=code_block_5)
code_block_6 = CodeBlock(connector=code_block_2, point=endPoint, pipetype=getItemAtIndex, level=getParameterValueByName) { connector; point; pipetype; level; }
python_script = Python(IN[0]=code_block_6.connector, IN[1]=code_block_6.point, IN[2]=code_block_6.pipetype, IN[3]=code_block_6.level)
# ---------- python_script.python (54 lines) ----------
import clr

clr.AddReference("RevitServices")
import RevitServices
from RevitServices.Persistence import DocumentManager
from RevitServices.Transactions import TransactionManager
doc = DocumentManager.Instance.CurrentDBDocument

clr.AddReference("RevitAPI")
import Autodesk
from Autodesk.Revit.DB import *

clr.AddReference("RevitNodes")
import Revit
clr.ImportExtensions(Revit.Elements)
clr.ImportExtensions(Revit.GeometryConversion)

toggle = 0

if isinstance(IN[0], list):
	connector1 = IN[0]
else:
	connector1 = [IN[0]]
	toggle = 1
if isinstance(IN[1], list):
	point = IN[1]
else:
	point = [IN[1]]
pipetype = UnwrapElement(IN[2])
if isinstance(IN[3], list):
	level = UnwrapElement(IN[3])
else:
	level = [UnwrapElement(IN[3])]
ll = len(level)


elements = []

TransactionManager.Instance.EnsureInTransaction(doc)
for i,conn1 in enumerate(connector1):
	try:
		levelid = level[i%ll].Id
		pipe = Autodesk.Revit.DB.Plumbing.Pipe.Create(doc,pipetype.Id,levelid,conn1,point[i].ToXyz())
	
		elements.append(pipe.ToDSType(False))
	except:
		elements.append(None)

TransactionManager.Instance.TransactionTaskDone()

if toggle:
	OUT = elements[0]
else:
	OUT = elements
# ----------------------------------------
byMEPCurves = Custom[MEPFitting.ByMEPCurves](MEPCurve1=code_block, MEPCurve2=python_script)  # Creates a UnionFitting or ElbowFitting by 2 MEPCurves (Ducts, Cable Trays, Pipes or Conduits). The output may not always be all the fittings created as Revit sometimes creates extra transition fittings outside of the node transactions.
startPoint = Curve.StartPoint(curve=byStartPointDirectionLength)
