# Dynamo graph Point Cloud Pipes_Python.dyn (Dynamo 2.0.3.8810)

point_number = DoubleSlider(3000, range=0..10000 step 0.1)  # graph input
boolean = BoolSelector(false)  # graph input
pointcloud_select_points_in_view = Custom[❄_Pointcloud Select Points in View](PointSampleSize=point_number, Refresh=boolean)  # (Sastrugi_Pointcloud_Geometry) This node allows users to select a specific number of Pointcloud Points by creating a selection region in the Active View.
count = List.Count(list=pointcloud_select_points_in_view.Points)  # graph output
code_block = CodeBlock(points=pointcloud_select_points_in_view.Points) { points; }
byBestFitThroughPoints = Line.ByBestFitThroughPoints(bestFitPoints=code_block)
number_circle = DoubleSlider(6, range=0..100 step 1)  # graph input
code_block_2 = CodeBlock(numdiv=number_circle) { 1/numdiv; }
code_block_3 = CodeBlock(div=code_block_2) { 0.1..1.0..(div); }
planeAtParameter = Curve.PlaneAtParameter(curve=byBestFitThroughPoints, param=code_block_3)
distanceTo = Geometry.DistanceTo(geometry=planeAtParameter, other=code_block, lacing=CrossProduct)
sortIndexByValue = List.SortIndexByValue(list=distanceTo)
code_block_4 = CodeBlock()
# ---------- code_block_4.designscript (2 lines) ----------
//number of point to take at each slice
20;
# ----------------------------------------
takeItems = List.TakeItems(list=sortIndexByValue@L2, amount=code_block_4)
getItemAtIndex = List.GetItemAtIndex(list=code_block, index=takeItems)
byBestFitThroughPoints_2 = Circle.ByBestFitThroughPoints(points=getItemAtIndex)
centerPoint = Circle.CenterPoint(circle=byBestFitThroughPoints_2)
byBestFitThroughPoints_3 = Line.ByBestFitThroughPoints(bestFitPoints=centerPoint)

# group: PipeType
element_types = ElementTypes(index=236)
all_elements_of_type = ElementsOfType(element_type=element_types)
number_slider = DoubleSlider(0, range=0..100 step 0.1)
getItemAtIndex_2 = List.GetItemAtIndex(list=all_elements_of_type, index=number_slider)

# group: PipingSyste,Type
element_types_2 = ElementTypes(index=238)
all_elements_of_type_2 = ElementsOfType(element_type=element_types_2)
number_slider_2 = DoubleSlider(0, range=0..15 step 1)
getItemAtIndex_3 = List.GetItemAtIndex(list=all_elements_of_type_2, index=number_slider_2)

# group: Input
levels = Levels(index=3)  # graph input

# group: Filter
radius = Circle.Radius(circle=byBestFitThroughPoints_2)
average = Math.Average(numbers=radius)
code_block_5 = CodeBlock(rad=average) { rad*2; }
round = Math.Round(number=code_block_5)

name_type = CodeBlock(line=byBestFitThroughPoints_3, PipeType=getItemAtIndex_2, SystemType=getItemAtIndex_3, level=levels, Dia=round) { line; PipeType; SystemType; level; Dia; }
byLines = Python(IN[0]=name_type.line, IN[1]=name_type.PipeType, IN[2]=name_type.SystemType, IN[3]=name_type.level, IN[4]=name_type.Dia)  # "Pipe.ByLines"
# ---------- byLines.python (98 lines) ----------
import clr

clr.AddReference("RevitServices")
import RevitServices
from RevitServices.Persistence import DocumentManager
from RevitServices.Transactions import TransactionManager
doc = DocumentManager.Instance.CurrentDBDocument

clr.AddReference("RevitAPI")
import Autodesk
from Autodesk.Revit.DB import *

clr.AddReference("RevitNodes")
import Revit
clr.ImportExtensions(Revit.Elements)
clr.ImportExtensions(Revit.GeometryConversion)


if isinstance(IN[0], list):
	lines = IN[0]
else:
	lines = [IN[0]]   # tăng thêm 1 cấp trong list
FirstPoint = [x.StartPoint for x in lines]
SecondPoint = [x.EndPoint for x in lines]


#chính là đòi em Dynamo mở cái khẩu trang ra cho anh Revit coi mắt và xem được, biết được em nó là con nhà ai, có vợ hay chưa có vợ.Rồi sau đó mới muốn làm gì thì làm.😁

## các giá trị từ dòng này đến 57 đều trả về 1


if isinstance(IN[1], list):
	pipetype = UnwrapElement(IN[1])
else:
	pipetype = [UnwrapElement(IN[1])]
ptl = len(pipetype)


if isinstance(IN[2], list):
	systemtype = UnwrapElement(IN[2])
else:
	systemtype = [UnwrapElement(IN[2])]
stl = len(systemtype)


if isinstance(IN[3], list):
	level = UnwrapElement(IN[3])
else:
	level = [UnwrapElement(IN[3])]
ll = len(level)


if isinstance(IN[4], list):
	diameter = IN[4]
else:
	diameter = [IN[4]]
dl = len(diameter)


#Khởi tạo 1 list rỗng.

elements = []

TransactionManager.Instance.EnsureInTransaction(doc)

#cho phép bạn truy nhập vòng lặp lần lượt qua các thành phần của một collection trong khi nó vẫn giữ index của item hiện tại.

for i,x in enumerate(FirstPoint):
	try:
	
	# Code lấy về giá trị ID chia % để không bị sót đối tượng.
	
		levelid = level[i%ll].Id
		systypeid = systemtype[i%stl].Id
		pipetypeid = pipetype[i%ptl].Id
		diam = diameter[i%dl]
		
#Pipe.Create.Method (Document, ElementId, ElementId, ElementId, XYZ, XYZ)		
		
		pipe = Autodesk.Revit.DB.Plumbing.Pipe.Create(doc,systypeid,pipetypeid,levelid,x.ToXyz(),SecondPoint[i].ToXyz())
		
		param = pipe.get_Parameter(BuiltInParameter.RBS_PIPE_DIAMETER_PARAM)
		param.SetValueString(diam.ToString())
	
		elements.append(pipe.ToDSType(False))
#Nếu không có ngoại lệ xảy ra, khối except sẽ được bỏ qua và chương trình theo luồng bình thường, nhưng nếu có bất cứ ngoại lệ nào nó sẽ bị chặn lại bởi except.
#Nếu khối lệnh trong try có 1 lỗi gì đó xảy ra thì chương trình sẽ tìm đến các except phía dưới, except nào thỏa mãn thì nó sẽ thực thi code trong khối except đó.



	except:
		
		elements.append(None)

TransactionManager.Instance.TransactionTaskDone()


OUT = elements
# ----------------------------------------
