# Dynamo graph HelloWorld.dyn (Dynamo 2.10.1.3976)

code_block = CodeBlock { "Hello World"; }
code_block_2 = CodeBlock { "BIM3DM"; }
number = DoubleInput(2000)
number_2 = DoubleInput(23)
add = number + number_2
boolean = BoolSelector(false)
python_script = Python(IN[0]=code_block, IN[1]=code_block_2, IN[2]=add, IN[3]=boolean)  # IronPython2
# ---------- python_script.python (48 lines) ----------
"""Copyright(c) 2019 by: duengocnguyen@gmail.com"""
'https://www.youtube.com/channel/UCt2JhCDDFxpYho575WTMZ4g'
"""________________Welcome to BIM3DM-DYNAMO API___________________"""
import clr 
import sys
sys.path.append(r'C:\Program Files\Autodesk\Revit 2020\AddIns\DynamoForRevit\IronPython.StdLib.2.7.8')
import math 
from System.Collections.Generic import *

clr.AddReference("ProtoGeometry")
from Autodesk.DesignScript.Geometry import *

clr.AddReference('RevitAPI')
import Autodesk
from Autodesk.Revit.DB import *

clr.AddReference('RevitAPIUI')
from Autodesk.Revit.UI import*
from  Autodesk.Revit.UI.Selection import*

clr.AddReference("RevitNodes")
import Revit
clr.ImportExtensions(Revit.Elements)
clr.ImportExtensions(Revit.GeometryConversion)

clr.AddReference("RevitServices")
import RevitServices
from RevitServices.Persistence import DocumentManager
from RevitServices.Transactions import TransactionManager

doc = DocumentManager.Instance.CurrentDBDocument
view = doc.ActiveView
uidoc = DocumentManager.Instance.CurrentUIApplication.ActiveUIDocument

import clr
import msvcrt
clr.AddReference("RevitAPIUI")
from  Autodesk.Revit.UI import *

msg = IN[0]
othor = IN[1]
year = IN[2]
button = TaskDialogCommonButtons.Ok
result = TaskDialogResult.Ok
msgBox = TaskDialog
dialogContent = str(IN[1]) + " " + str(IN[2]) + " "+ str(IN[0])
buttons = TaskDialogCommonButtons.Yes | TaskDialogCommonButtons.No
dialogResult = TaskDialog.Show('Delete all MEP',dialogContent,buttons)
# ----------------------------------------
