# Dynamo graph Create_Node_Pipe_By_Lines.dyn (Dynamo 2.10.1.3976)
# packages: BIM3DM 2.1.24

# group: PipingSystemType
element_classes = ElementTypes("PipingSystemType")
all_elements_of_class = ElementsOfType(element_class=element_classes)
code_block = CodeBlock(a=all_elements_of_class) { a.Name; }
code_block_2 = CodeBlock { "Other"; }
code_block_3 = CodeBlock(x=code_block, y=code_block_2) { x==y; }
filterByBoolMask = List.FilterByBoolMask(list=all_elements_of_class, mask=code_block_3)
code_block_4 = CodeBlock(a=filterByBoolMask.out) { a.Name; }

code = Custom[Code]()  # package BIM3DM; Let me coding. haha

# group: VS Code
boolean = BoolSelector(true)
python_script = Python(IN[0]=boolean)  # IronPython2
# ---------- python_script.python (5 lines) ----------
re  = open(r"A:\Library-Dynamo-Python-CSharp\test.py", "r")

interpret = re.read()

OUT =  interpret
# ----------------------------------------
python_script_from_string = PythonStringNode(script=python_script)  # IronPython2; unwired: IN[0], IN[1], IN[2], IN[3], IN[4]

select_edges = SelectEdges()  # 8 picked in the model

# group: PipeType
element_classes_2 = ElementTypes("PipeType")
all_elements_of_class_2 = ElementsOfType(element_class=element_classes_2)
code_block_5 = CodeBlock(a=all_elements_of_class_2) { a.Name; }
code_block_6 = CodeBlock { "PVC - DWV"; }
code_block_7 = CodeBlock(x=code_block_5, y=code_block_6) { x==y; }
filterByBoolMask_2 = List.FilterByBoolMask(list=all_elements_of_class_2, mask=code_block_7)

levels = Levels("L1")
code_block_8 = CodeBlock { 100; }
pipesByLines = Python(IN[0]=select_edges, IN[1]=filterByBoolMask_2.in, IN[2]=filterByBoolMask.in, IN[3]=levels, IN[4]=code_block_8)  # IronPython2
# ---------- pipesByLines.python (77 lines) ----------
"""Copyright(c) 2023 by: duengocnguyen@gmail.com"""
'https://www.youtube.com/channel/UCt2JhCDDFxpYho575WTMZ4g'
"""________________Welcome to BIM3DM-DYNAMO API___________________"""
import clr
clr.AddReference("RevitServices")
import RevitServices
from RevitServices.Persistence import DocumentManager
from RevitServices.Transactions import TransactionManager
doc = DocumentManager.Instance.CurrentDBDocument

clr.AddReference("RevitAPI")
import Autodesk
from Autodesk.Revit.DB import *

clr.AddReference("RevitNodes")
import Revit
clr.ImportExtensions(Revit.Elements)
clr.ImportExtensions(Revit.GeometryConversion)

################################################################
lines = IN[0]
pipeTypes = IN[1]
systemTypes = IN[2]
levels = IN[3]
diameters = IN[4]

if isinstance(lines, list):
    lines = lines
else:
    lines = [lines]

if isinstance(pipeTypes, list):
    pipeTypes = UnwrapElement(pipeTypes)
else:
    pipeTypes = [UnwrapElement(pipeTypes)]
lenPipeType = len(pipeTypes)


if isinstance(systemTypes, list):
    systemTypes = UnwrapElement(systemTypes)
else:
    systemTypes = [UnwrapElement(systemTypes)]
lenSystemType = len(systemTypes)

if isinstance(levels, list):
    levels = UnwrapElement(levels)
else:
    levels = [UnwrapElement(levels)]
lenLevel = len(levels)

if isinstance(diameters, list):
    diameters = diameters
else:
    diameters = [diameters]
diaLen = len(diameters)


firstPoints = [x.StartPoint for x in lines]
secondPoints = [x.EndPoint for x in lines]

pipes = []
TransactionManager.Instance.EnsureInTransaction(doc)
for index, point in enumerate(firstPoints):
    try:
        systemTypeId = systemTypes[index%lenSystemType].Id
        pipeTypeId = pipeTypes[index%lenPipeType].Id
        levelId = levels[index%lenLevel].Id
        diam = diameters[index%diaLen]
        pipe = Autodesk.Revit.DB.Plumbing.Pipe.Create(doc, systemTypeId, pipeTypeId, levelId, point.ToXyz(),secondPoints[index].ToXyz())
        param = pipe.get_Parameter(BuiltInParameter.RBS_PIPE_DIAMETER_PARAM)
        param.SetValueString(diam.ToString())
        
        pipes.append(pipe.ToDSType(False))
    except:
        pipes.append(None)
TransactionManager.Instance.TransactionTaskDone()
OUT = pipes
# ----------------------------------------
