# Dynamo graph Fix2_CreateFramingByIfc_MethodByEdges.dyn (Dynamo 2.3.0.5885)
# packages: Spring - Dynamo 2.0 0.0.3

select_edges_1 = SelectEdges()  # 2 picked in the model; graph input
code_block = CodeBlock(a=select_edges_1) { a[0]; }
code_block_2 = CodeBlock(a=select_edges_1) { a[1]; }
middleLineBy2Lines = Geometry.Curves.MiddleLineBy2Lines(line1=code_block, line2=code_block_2)
levels = Levels("1FL")  # graph input
select_model_elements = Python()  # unwired: IN[0]
# ---------- select_model_elements.python (30 lines) ----------
import clr
clr.AddReference('RevitAPI')
import Autodesk
from Autodesk.Revit.DB import *

clr.AddReference("RevitServices")
import RevitServices
from RevitServices.Persistence import DocumentManager

clr.AddReference("RevitAPIUI")
from  Autodesk.Revit.UI import *

clr.AddReference("RevitNodes")
import Revit
clr.ImportExtensions(Revit.Elements)
 
doc = DocumentManager.Instance.CurrentDBDocument
uidoc=DocumentManager.Instance.CurrentUIApplication.ActiveUIDocument

obType = Selection.ObjectType.Element
list = uidoc.Selection.PickObjects(obType, "🐶🐶🐶 Please!!!Seclect From 1st to 6th of Elemnets.🐶🐶🐶🐶 ")
result = []
name = []
for ref in list:
	element = doc.GetElement(ref.ElementId)
	result.Add(element.ToDSType(True))
	
	
	
OUT = result
# ----------------------------------------
string_from_object = FromObject(obj=select_model_elements)
byName = FamilyType.ByName(name=string_from_object)  # graph output
code_block_3 = CodeBlock(a=byName) { a[0]; a[1]; a[2]; a[3]; a[4]; a[5]; }
beamByCurve = StructuralFraming.BeamByCurve(curve=middleLineBy2Lines, level=levels, structuralFramingType=code_block_3.out0)  # graph output
select_edges_2 = SelectEdges()  # 2 picked in the model; graph input
code_block_4 = CodeBlock(a=select_edges_2) { a[0]; }
code_block_5 = CodeBlock(a=select_edges_2) { a[1]; }
middleLineBy2Lines_2 = Geometry.Curves.MiddleLineBy2Lines(line1=code_block_4, line2=code_block_5)
beamByCurve_2 = StructuralFraming.BeamByCurve(curve=middleLineBy2Lines_2, level=levels, structuralFramingType=code_block_3.out1)  # graph output
select_edges_3 = SelectEdges()  # 2 picked in the model; graph input
code_block_6 = CodeBlock(a=select_edges_3) { a[0]; }
code_block_7 = CodeBlock(a=select_edges_3) { a[1]; }
middleLineBy2Lines_3 = Geometry.Curves.MiddleLineBy2Lines(line1=code_block_6, line2=code_block_7)
beamByCurve_3 = StructuralFraming.BeamByCurve(curve=middleLineBy2Lines_3, level=levels, structuralFramingType=code_block_3.out2)  # graph output
select_edges_4 = SelectEdges()  # 2 picked in the model; graph input
code_block_8 = CodeBlock(a=select_edges_4) { a[0]; }
code_block_9 = CodeBlock(a=select_edges_4) { a[1]; }
middleLineBy2Lines_4 = Geometry.Curves.MiddleLineBy2Lines(line1=code_block_8, line2=code_block_9)
beamByCurve_4 = StructuralFraming.BeamByCurve(curve=middleLineBy2Lines_4, level=levels, structuralFramingType=code_block_3.out3)  # graph output
select_edges_5 = SelectEdges()  # 2 picked in the model; graph input
code_block_10 = CodeBlock(a=select_edges_5) { a[0]; }
code_block_11 = CodeBlock(a=select_edges_5) { a[1]; }
middleLineBy2Lines_5 = Geometry.Curves.MiddleLineBy2Lines(line1=code_block_10, line2=code_block_11)
beamByCurve_5 = StructuralFraming.BeamByCurve(curve=middleLineBy2Lines_5, level=levels, structuralFramingType=code_block_3.out4)  # graph output
select_edges_6 = SelectEdges()  # 2 picked in the model; graph input
code_block_12 = CodeBlock(a=select_edges_6) { a[0]; }
code_block_13 = CodeBlock(a=select_edges_6) { a[1]; }
middleLineBy2Lines_6 = Geometry.Curves.MiddleLineBy2Lines(line1=code_block_12, line2=code_block_13)
beamByCurve_6 = StructuralFraming.BeamByCurve(curve=middleLineBy2Lines_6, level=levels, structuralFramingType=code_block_3.out5)  # graph output
