# Dynamo graph Fix_Element_Geometry.dyn (Dynamo 2.10.1.3976)
# packages: BIM3DM 2.1.4

boolean = BoolSelector(true)
selectionPickObjects = Custom[SelectionPickObjects](reset=boolean)  # package BIM3DM; Selection.PickObjects allow the user to pick multiple objects include (referece & family) in Autodesk Revit using the Revit API.
geometryByElementsV3 = Custom[GeometryByElementsV3](rabars=selectionPickObjects.Family)  # A node written for the case of retrieving geometric objects within a Rebar.
DBLineByGeometry = Custom[DBLineByGeometry](DBGeometry=geometryByElementsV3)  # package BIM3DM; Extract actual Autodesk.Revit.DB.Line from Geometries.
conversionRtD = Custom[ConversionRtD](Objects=DBLineByGeometry)  # package BIM3DM; Return an object entity that can be displayed on the Dynamo interface.
toProtoTypeLevel3 = Custom[ToProtoTypeLevel3](Objects=DBLineByGeometry)  # Return an object that Dynamo can display for you.
DBSolidByGeometry = Custom[DBSolidByGeometry](DBGeometry=geometryByElementsV3)  # package BIM3DM; Extract actual Autodesk.Revit.DB.Solid from Geometries.
toProtoTypeLevel3_2 = Custom[ToProtoTypeLevel3](Objects=DBSolidByGeometry)
select_model_element = DSModelElementSelection()  # 1 picked in the model
geometry = Element.Geometry(element=select_model_element)
