# Dynamo graph Modun_Rebar.dyn (Dynamo 2.10.1.3976)
# packages: BIM4Struc.Rebar 1.3.0

select_model_elements = DSModelElementsSelection()  # 1 picked in the model
number = DoubleInput(200)
number_2 = DoubleInput(100)
boolean = BoolSelector(true)
boolean_2 = BoolSelector(true)
rebarSetLayoutAsNumberWithSpacing = Custom[RebarSetLayoutAsNumberWithSpacing](rebarElement=select_model_elements, Quantity=number, Spacing=number_2, barsOnNormalSide=boolean, IncludeFirstBar=boolean, IncludeLastBar=boolean, InputInMM=boolean_2)  # frozen; Set the arrangement rule of the rebar set to 'NumberWithSpacing'
select_model_elements_2 = DSModelElementsSelection()  # 1 picked in the model; frozen
number_3 = DoubleInput(50)
number_4 = DoubleInput(10000)
boolean_3 = BoolSelector(true)
boolean_4 = BoolSelector(true)
rebarSetLayoutAsMinimumClearSpacing = Custom[RebarSetLayoutAsMinimumClearSpacing](rebarElement=select_model_elements_2, Spacing=number_3, RebarSetLength=number_4, barsOnNormalSide=boolean_3, IncludeFirstBar=boolean_3, IncludeLastBar=boolean_3, InputInMM=boolean_4)  # Adjusts the rebar set's Layout Rule property to use 'Minimum Clear Spacing'.
setLayoutAsMaximumSpacing = Custom[Rebar.SetLayoutAsMaximumSpacing]()  # package BIM4Struc.Rebar; Sets the Layout Rule property of rebar set to Maximum Spacing; unwired: rebarElement, Spacing, RebarSetLength
setLayoutAsMinimumClearSpacing = Custom[Rebar.SetLayoutAsMinimumClearSpacing]()  # package BIM4Struc.Rebar; Sets the Layout Rule property of rebar set to MinimumClearSpacing.; unwired: rebarElement, Spacing, RebarSetLength
setLayoutAsNumberWithSpacing = Custom[Rebar.SetLayoutAsNumberWithSpacing]()  # package BIM4Struc.Rebar; Sets the Layout Rule property of rebar set to NumberWithSpacing; unwired: rebarElement, Quantity, Spacing
select_model_elements_3 = DSModelElementsSelection()  # 1 picked in the model
number_5 = DoubleInput(50)
number_6 = DoubleInput(5000)
boolean_5 = BoolSelector(true)
boolean_6 = BoolSelector(true)
rebarSetLayoutAsMaximumSpacing = Custom[RebarSetLayoutAsMaximumSpacing](rebarElement=select_model_elements_3, Spacing=number_5, RebarSetLength=number_6, barsOnNormalSide=boolean_5, IncludeFirstBar=boolean_5, IncludeLastBar=boolean_5, InputInMM=boolean_6)  # frozen; Adjusts the rebar set's Layout Rule property to use Maximum Spacing.
select_model_elements_4 = DSModelElementsSelection()  # 1 picked in the model; frozen
number_7 = DoubleInput(200)
number_8 = DoubleInput(10000)
boolean_7 = BoolSelector(true)
boolean_8 = BoolSelector(true)
rebarSetLayoutAsFixedNumber = Custom[RebarSetLayoutAsFixedNumber](rebarElement=select_model_elements_4, Quantity=number_7, RebarSetLength=number_8, barsOnNormalSide=boolean_7, IncludeFirstBar=boolean_7, IncludeLastBar=boolean_7, InputInMM=boolean_8)  # Adjusts the rebar set's Layout Rule property to use 'Fixed Number'.
setLayoutAsFixedNumber = Custom[Rebar.SetLayoutAsFixedNumber]()  # package BIM4Struc.Rebar; Sets the Layout Rule property of rebar set to FixedNumber.; unwired: rebarElement, Quantity, RebarSetLength
select_model_elements_5 = DSModelElementsSelection()  # 1 picked in the model; frozen
rebarSetLayoutAsSingle = Custom[RebarSetLayoutAsSingle](rebarElement=select_model_elements_5)  # Changes the Layout Rule property of the rebar set to Single.
setDistributionType = Custom[Rebar.SetDistributionType]()  # package BIM4Struc.Rebar; Toggle to set the distribution type of a rebar set to "Varying Length" (True) or "Uniform" (False); unwired: rebarElement
