# Dynamo graph Pies_Connection_AxisX.dyn (Dynamo 2.0.3.8810)

select_model_element = Python()  # unwired: IN[0]
# ---------- select_model_element.python (28 lines) ----------
import clr
clr.AddReference('RevitAPI')
import Autodesk
from Autodesk.Revit.DB import *

clr.AddReference("RevitServices")
import RevitServices
from RevitServices.Persistence import DocumentManager

clr.AddReference("RevitAPIUI")
from  Autodesk.Revit.UI import *

clr.AddReference("RevitNodes")
import Revit
clr.ImportExtensions(Revit.GeometryConversion)



doc = DocumentManager.Instance.CurrentDBDocument
uidoc=DocumentManager.Instance.CurrentUIApplication.ActiveUIDocument

sel  = uidoc.Selection

obType = Selection.ObjectType.Element
ref = sel.PickObject(obType, "🐶🐶🐶 Please!!!Seclect Model Elemnets.🐶🐶🐶🐶 ")
element = doc.GetElement(ref.ElementId)

OUT = element
# ----------------------------------------
python_connector = Python(IN[0]=select_model_element)
# ---------- python_connector.python (44 lines) ----------
import clr
import math

clr.AddReference("RevitServices")
import RevitServices
from RevitServices.Persistence import DocumentManager
from RevitServices.Transactions import TransactionManager
doc = DocumentManager.Instance.CurrentDBDocument

clr.AddReference("RevitAPI")
import Autodesk
from Autodesk.Revit.DB import *

clr.AddReference("RevitNodes")
import Revit
clr.ImportExtensions(Revit.Elements)
clr.ImportExtensions(Revit.GeometryConversion)
#The inputs to this node will be stored as a list in the IN variables.
if isinstance(IN[0], list):
	elements = UnwrapElement(IN[0])
	toggle = 0
else:
	toggle = 1
	elements = [UnwrapElement(IN[0])]
	

listout = []

for element in elements:
	try:
		connectors = element.MEPModel.ConnectorManager.Connectors
	except:
		try:
			connectors = element.ConnectorManager.Connectors
		except:			
			connectors = []
	listout.append([x for x in connectors])


#Assign your output to the OUT variable.
if toggle:
	OUT = connectors
else:
	OUT = listout
# ----------------------------------------
isConnected = Python(IN[0]=python_connector)  # "Connector.IsConnected"
# ---------- isConnected.python (42 lines) ----------
import clr

clr.AddReference("RevitServices")
import RevitServices
from RevitServices.Persistence import DocumentManager
from RevitServices.Transactions import TransactionManager
doc = DocumentManager.Instance.CurrentDBDocument

clr.AddReference("RevitAPI")
import Autodesk
from Autodesk.Revit.DB import *

clr.AddReference("RevitNodes")
import Revit
clr.ImportExtensions(Revit.Elements)
clr.ImportExtensions(Revit.GeometryConversion)

#Many thanks to Konrad K Sobon for his awesome ProcessList function!
def Unwrap(item):
	return UnwrapElement(item)

def ProcessList(_func, _list):
    return map( lambda x: ProcessList(_func, x) if type(x)==list else _func(x), _list )

if isinstance(IN[0], list):
	connectors = ProcessList(Unwrap, IN[0])
else:
	connectors = [Unwrap(IN[0])]
	
	
def IsConnected(connector):
	bool = False
	try:
		bool = connector.IsConnected
	except:
		pass
	return bool

			
#Assign your output to the OUT variable.

OUT = ProcessList(IsConnected, connectors)
# ----------------------------------------
filterByBoolMask = List.FilterByBoolMask(list=python_connector, mask=isConnected)
flatten = List.Flatten(list=filterByBoolMask.out)
code_block = CodeBlock(a=flatten) { a[0]; }
code_block_2 = CodeBlock(MainCurveMEP=code_block) { MainCurveMEP; }
location = Python(IN[0]=code_block)  # "Connector.Location"
# ---------- location.python (41 lines) ----------
import clr

clr.AddReference("RevitServices")
import RevitServices
from RevitServices.Persistence import DocumentManager
from RevitServices.Transactions import TransactionManager
doc = DocumentManager.Instance.CurrentDBDocument

clr.AddReference("RevitAPI")
import Autodesk
from Autodesk.Revit.DB import *

clr.AddReference("RevitNodes")
import Revit
clr.ImportExtensions(Revit.Elements)
clr.ImportExtensions(Revit.GeometryConversion)

#Many thanks to Konrad K Sobon for his awesome ProcessList function!
def Unwrap(item):
	return UnwrapElement(item)

def ProcessList(_func, _list):
    return map( lambda x: ProcessList(_func, x) if type(x)==list else _func(x), _list )

if isinstance(IN[0], list):
	connectors = ProcessList(Unwrap, IN[0])
else:
	connectors = [Unwrap(IN[0])]
	
	
def getPoint(connector):
	try:
		return connector.Origin.ToPoint()
	except:
		return None


			
#Assign your output to the OUT variable.

OUT = ProcessList(getPoint, connectors)
# ----------------------------------------
direction_BasisX = Python(IN[0]=code_block)  # "Connector.Direction_BasisX"
# ---------- direction_BasisX.python (41 lines) ----------
import clr

clr.AddReference("RevitServices")
import RevitServices
from RevitServices.Persistence import DocumentManager
from RevitServices.Transactions import TransactionManager
doc = DocumentManager.Instance.CurrentDBDocument

clr.AddReference("RevitAPI")
import Autodesk
from Autodesk.Revit.DB import *

clr.AddReference("RevitNodes")
import Revit
clr.ImportExtensions(Revit.Elements)
clr.ImportExtensions(Revit.GeometryConversion)

#Many thanks to Konrad K Sobon for his awesome ProcessList function!
def Unwrap(item):
	return UnwrapElement(item)

def ProcessList(_func, _list):
    return map( lambda x: ProcessList(_func, x) if type(x)==list else _func(x), _list )

if isinstance(IN[0], list):
	connectors = ProcessList(Unwrap, IN[0])
else:
	connectors = [Unwrap(IN[0])]
	
	
def getConnDir(connector):
	try:
		return connector.CoordinateSystem.BasisX.ToVector()
	except:
		return None


			
#Assign your output to the OUT variable.

OUT = ProcessList(getConnDir, connectors)
# ----------------------------------------
python = Python(IN[0]=code_block)
# ---------- python.python (41 lines) ----------
import clr

clr.AddReference("RevitServices")
import RevitServices
from RevitServices.Persistence import DocumentManager
from RevitServices.Transactions import TransactionManager
doc = DocumentManager.Instance.CurrentDBDocument

clr.AddReference("RevitAPI")
import Autodesk
from Autodesk.Revit.DB import *

clr.AddReference("RevitNodes")
import Revit
clr.ImportExtensions(Revit.Elements)
clr.ImportExtensions(Revit.GeometryConversion)

#Many thanks to Konrad K Sobon for his awesome ProcessList function!
def Unwrap(item):
	return UnwrapElement(item)

def ProcessList(_func, _list):
    return map( lambda x: ProcessList(_func, x) if type(x)==list else _func(x), _list )

if isinstance(IN[0], list):
	connectors = ProcessList(Unwrap, IN[0])
else:
	connectors = [Unwrap(IN[0])]
	
	
def getConnDir(connector):
	try:
		return connector.CoordinateSystem.BasisZ.ToVector()
	except:
		return None


			
#Assign your output to the OUT variable.

OUT = ProcessList(getConnDir, connectors)
# ----------------------------------------
pipe_rotate = DoubleSlider(0, range=0..180 step 0.1)  # graph input
rotate = Vector.Rotate(vector=direction_BasisX, axis=python, degrees=pipe_rotate)  # graph output
length_pipes = DoubleInput(700)  # graph input
byStartPointDirectionLength = Line.ByStartPointDirectionLength(startPoint=location, direction=rotate, length=length_pipes)
endPoint = Curve.EndPoint(curve=byStartPointDirectionLength)
element_types = ElementTypes(index=236)
all_elements_of_type = ElementsOfType(element_type=element_types)
number_slider = DoubleSlider(0, range=0..100 step 0.1)
getItemAtIndex = List.GetItemAtIndex(list=all_elements_of_type, index=number_slider)
code_block_3 = CodeBlock { "Reference Level"; }
getParameterValueByName = Element.GetParameterValueByName(element=select_model_element, parameterName=code_block_3)
code_block_4 = CodeBlock(connector=code_block, point=endPoint, pipetype=getItemAtIndex, level=getParameterValueByName) { connector; point; pipetype; level; }
python_script = Python(IN[0]=code_block_4.connector, IN[1]=code_block_4.point, IN[2]=code_block_4.pipetype, IN[3]=code_block_4.level)
# ---------- python_script.python (54 lines) ----------
import clr

clr.AddReference("RevitServices")
import RevitServices
from RevitServices.Persistence import DocumentManager
from RevitServices.Transactions import TransactionManager
doc = DocumentManager.Instance.CurrentDBDocument

clr.AddReference("RevitAPI")
import Autodesk
from Autodesk.Revit.DB import *

clr.AddReference("RevitNodes")
import Revit
clr.ImportExtensions(Revit.Elements)
clr.ImportExtensions(Revit.GeometryConversion)

toggle = 0

if isinstance(IN[0], list):
	connector1 = IN[0]
else:
	connector1 = [IN[0]]
	toggle = 1
if isinstance(IN[1], list):
	point = IN[1]
else:
	point = [IN[1]]
pipetype = UnwrapElement(IN[2])
if isinstance(IN[3], list):
	level = UnwrapElement(IN[3])
else:
	level = [UnwrapElement(IN[3])]
ll = len(level)


elements = []

TransactionManager.Instance.EnsureInTransaction(doc)
for i,conn1 in enumerate(connector1):
	try:
		levelid = level[i%ll].Id
		pipe = Autodesk.Revit.DB.Plumbing.Pipe.Create(doc,pipetype.Id,levelid,conn1,point[i].ToXyz())
	
		elements.append(pipe.ToDSType(False))
	except:
		elements.append(None)

TransactionManager.Instance.TransactionTaskDone()

if toggle:
	OUT = elements[0]
else:
	OUT = elements
# ----------------------------------------
byMEPCurves = Custom[MEPFitting.ByMEPCurves](MEPCurve1=code_block_2, MEPCurve2=python_script)  # Creates a UnionFitting or ElbowFitting by 2 MEPCurves (Ducts, Cable Trays, Pipes or Conduits). The output may not always be all the fittings created as Revit sometimes creates extra transition fittings outside of the node transactions.
