# Dynamo graph Script_Rebar_By_Curves_v1.dyn (Dynamo 2.18.1.5096)
# packages: Dynamo for Rebar 2.0.2, BIM3DM 2.1.16, Structural Design 2024.4.15

# group: VS Code
boolean = BoolSelector(false)
python_script = Python(IN[0]=boolean)  # IronPython2
# ---------- python_script.python (5 lines) ----------
re  = open(r"A:\Library-Dynamo-Python-CSharp\test.py", "r")

interpret = re.read()

OUT =  interpret
# ----------------------------------------
python_script_from_string = PythonStringNode(script=python_script)  # CPython3; unwired: IN[0]

select_edges = SelectEdges()  # 3 picked in the model
code_block = CodeBlock(lines=select_edges) { lines; }
getDBLineFormEleLine = Python(IN[0]=code_block)  # IronPython2
# ---------- getDBLineFormEleLine.python (43 lines) ----------
import clr 
import System
import math 
from System.Collections.Generic import *

clr.AddReference("ProtoGeometry")
from Autodesk.DesignScript.Geometry import *
from Autodesk.DesignScript.Geometry import PolyCurve, Line

clr.AddReference('RevitAPI')
import Autodesk
from Autodesk.Revit.DB import *

clr.AddReference('RevitAPIUI')
from Autodesk.Revit.UI import*
from  Autodesk.Revit.UI.Selection import*

clr.AddReference("RevitNodes")
import Revit
clr.ImportExtensions(Revit.Elements)
clr.ImportExtensions(Revit.GeometryConversion)

clr.AddReference("RevitServices")
import RevitServices
from RevitServices.Persistence import DocumentManager
from RevitServices.Transactions import TransactionManager
from Autodesk.DesignScript.Geometry import Line
doc = DocumentManager.Instance.CurrentDBDocument
view = doc.ActiveView
uidoc = DocumentManager.Instance.CurrentUIApplication.ActiveUIDocument
#########################################################################


def getDBLineFormEleLine(lines): # Get Revit.DB.Line from Curve Elements
    opt = Options()
    opt.ComputeReferences = True
    opt.IncludeNonVisibleObjects = True
    opt.View = doc.ActiveView
    dbLine = []
    for l in lines:
        dbLine.append(UnwrapElement(l).ToRevitType())
    return dbLine
OUT = getDBLineFormEleLine(IN[0])
# ----------------------------------------
code_block_2 = CodeBlock { 0; 150; -100; }
boolean_2 = BoolSelector(true)
getXyzItemsByOffsetPointsFromDbLines = Python(IN[0]=getDBLineFormEleLine, IN[1]=code_block_2.out0, IN[2]=code_block_2.out1, IN[3]=code_block_2.out2, IN[4]=boolean_2)  # IronPython2
# ---------- getXyzItemsByOffsetPointsFromDbLines.python (45 lines) ----------
import clr 
import System
import math 
from System.Collections.Generic import *

clr.AddReference("ProtoGeometry")
from Autodesk.DesignScript.Geometry import *
from Autodesk.DesignScript.Geometry import PolyCurve, Line

clr.AddReference('RevitAPI')
import Autodesk
from Autodesk.Revit.DB import *

clr.AddReference('RevitAPIUI')
from Autodesk.Revit.UI import*
from  Autodesk.Revit.UI.Selection import*

clr.AddReference("RevitNodes")
import Revit
clr.ImportExtensions(Revit.Elements)
clr.ImportExtensions(Revit.GeometryConversion)

clr.AddReference("RevitServices")
import RevitServices
from RevitServices.Persistence import DocumentManager
from RevitServices.Transactions import TransactionManager
from Autodesk.DesignScript.Geometry import Line
doc = DocumentManager.Instance.CurrentDBDocument
view = doc.ActiveView
uidoc = DocumentManager.Instance.CurrentUIApplication.ActiveUIDocument
#########################################################################
def getXyzItemsByOffsetPointsFromDbLines(lines, deltaX = 0, deltaY = 0, deltaZ =0):
    xyzItems = []
    for line in lines:
        startPoint = line.GetEndPoint(0)
        endPoint = line.GetEndPoint(1)
        newStartPoint = XYZ(startPoint.X - deltaX, startPoint.Y - deltaY,startPoint.Z - deltaZ )
        endStartPoint = XYZ(endPoint.X - deltaX, endPoint.Y - deltaY,endPoint.Z - deltaZ )
        xyzItems.append([newStartPoint, endStartPoint])
    return xyzItems

deltaX = IN[1]/304.8
deltaY = IN[2]/304.8
deltaZ = IN[3]/304.8
OUT = getXyzItemsByOffsetPointsFromDbLines(IN[0], deltaX, deltaY, deltaZ)
# ----------------------------------------
createDbLinesByPoints = Python(IN[0]=getXyzItemsByOffsetPointsFromDbLines)  # CPython3
# ---------- createDbLinesByPoints.python (36 lines) ----------
import clr
import System
import math 
from System.Collections.Generic import *

clr.AddReference('ProtoGeometry')
from Autodesk.DesignScript.Geometry import *

clr.AddReference('RevitAPI')
import Autodesk
from Autodesk.Revit.DB import *

clr.AddReference('RevitAPIUI')
from Autodesk.Revit.UI import*
from  Autodesk.Revit.UI.Selection import*

clr.AddReference("RevitNodes")
import Revit
clr.ImportExtensions(Revit.Elements)
clr.ImportExtensions(Revit.GeometryConversion)

clr.AddReference("RevitServices")
import RevitServices
from RevitServices.Persistence import DocumentManager
from RevitServices.Transactions import TransactionManager

doc = DocumentManager.Instance.CurrentDBDocument
view = doc.ActiveView
uidoc = DocumentManager.Instance.CurrentUIApplication.ActiveUIDocument
#########################################################################
def createDbLinesByPoints(xyzItems):
    dbLines = []
    for xyz in xyzItems:
        dbLines.append(Line.CreateBound(xyz[0],xyz[1]))
    return dbLines
OUT = createDbLinesByPoints(IN[0])
# ----------------------------------------
conversionRtD = Custom[ConversionRtD](Objects=createDbLinesByPoints)  # package BIM3DM; Return an object entity that can be displayed on the Dynamo interface.
byJoinedCurves = PolyCurve.ByJoinedCurves(curves=conversionRtD)
select_model_element = DSModelElementSelection()  # 1 picked in the model
code_block_3 = CodeBlock(a=select_model_element) { a.Id; }
rebarStyle = RevitRebarStyle("StirrupTie")
stirrup_rebar_diameter = RevitRebarBarType("Ø40")  # graph input
rebarHookOrientation = RevitRebarHookOrientation("Left")
rebarHookType = RevitRebarHookType("None")
normal = Curve.Normal(curve=byJoinedCurves)
byCurve = Rebar.ByCurve(curve=byJoinedCurves, hostElementId=code_block_3, rebarStyle=rebarStyle, rebarBarType=stirrup_rebar_diameter, startHookOrientation=rebarHookOrientation, endHookOrientation=rebarHookOrientation, startHookType=rebarHookType, endHookType=rebarHookType, vector=normal)
code_block_4 = CodeBlock { 200; }
select_line_from_bridge_cross = SelectEdges()  # "Select Line from Bridge Cross Section"; 1 picked in the model
code_block_5 = CodeBlock(line=select_line_from_bridge_cross) { line.Length; }
ceiling = Math.Ceiling(number=code_block_5)
boolean_3 = BoolSelector(true)
boolean_4 = BoolSelector(false)
boolean_5 = BoolSelector(true)
rebarSetLayoutAsMaximumSpacing = Custom[RebarSetLayoutAsMaximumSpacing](rebarElement=byCurve, Spacing=code_block_4, RebarSetLength=ceiling, barsOnNormalSide=boolean_3, IncludeFirstBar=boolean_3, IncludeLastBar=boolean_4, InputInMM=boolean_5)  # package BIM3DM; Adjusts the rebar set's Layout Rule property to use Maximum Spacing.
normal_2 = Curve.Normal(curve=byJoinedCurves)
getDBLineFormEleLine_2 = Python(IN[0]=code_block)  # IronPython2; same code as getDBLineFormEleLine
code_block_6 = CodeBlock { 0; 150; -550; }
boolean_6 = BoolSelector(true)
getXyzItemsByOffsetPointsFromDbLines_2 = Python(IN[0]=getDBLineFormEleLine_2, IN[1]=code_block_6.out0, IN[2]=code_block_6.out1, IN[3]=code_block_6.out2, IN[4]=boolean_6)  # IronPython2; same code as getXyzItemsByOffsetPointsFromDbLines
createDbLinesByPoints_2 = Python(IN[0]=getXyzItemsByOffsetPointsFromDbLines_2)  # CPython3; same code as createDbLinesByPoints
conversionRtD_2 = Custom[ConversionRtD](Objects=createDbLinesByPoints_2)
byJoinedCurves_2 = PolyCurve.ByJoinedCurves(curves=conversionRtD_2)
normal_3 = Curve.Normal(curve=byJoinedCurves_2)
byCurve_2 = Rebar.ByCurve(curve=byJoinedCurves_2, hostElementId=code_block_3, rebarStyle=rebarStyle, rebarBarType=stirrup_rebar_diameter, startHookOrientation=rebarHookOrientation, endHookOrientation=rebarHookOrientation, startHookType=rebarHookType, endHookType=rebarHookType, vector=normal_3)
rebarSetLayoutAsMaximumSpacing_2 = Custom[RebarSetLayoutAsMaximumSpacing](rebarElement=byCurve_2, Spacing=code_block_4, RebarSetLength=ceiling, barsOnNormalSide=boolean_3, IncludeFirstBar=boolean_3, IncludeLastBar=boolean_4, InputInMM=boolean_5)
packages = CodeBlock()
# ---------- packages.designscript (9 lines) ----------
/*


+ Dynamo for Rebar: 2.0.2
+ BIM3DM
+ Structural Design: 2024.4.15;


*/;
# ----------------------------------------
