# Dynamo graph RebarBycurve_Complex.dyn (Dynamo 2.10.1.3976)
# packages: Dynamo for Rebar 2.0.2

outRadisus = DoubleSlider(1900, range=0..5000 step 100)  # graph input
amount = DoubleSlider(30, range=0..300 step 1)  # graph input
select_face = DSFaceSelection()  # 1 picked in the model; graph input
center_point = CodeBlock(t1=select_face) { point1 = Surface.PointAtParameter(t1, 0.5, 0.5); }
center_xyz = Python(IN[0]=center_point)  # IronPython2
# ---------- center_xyz.python (39 lines) ----------
"""Copyright(c) 2019 by: duengocnguyen@gmail.com"""
'https://www.youtube.com/channel/UCt2JhCDDFxpYho575WTMZ4g'
"""________________Welcome to BIM3DM-DYNAMO API___________________"""
import clr 
import sys
sys.path.append(r'C:\Program Files\Autodesk\Revit 2020\AddIns\DynamoForRevit\IronPython.StdLib.2.7.8')
import math 
from System.Collections.Generic import *

clr.AddReference("ProtoGeometry")
from Autodesk.DesignScript.Geometry import *

clr.AddReference('RevitAPI')
import Autodesk
from Autodesk.Revit.DB import *

clr.AddReference('RevitAPIUI')
from Autodesk.Revit.UI import*
from  Autodesk.Revit.UI.Selection import*

clr.AddReference("RevitNodes")
import Revit
clr.ImportExtensions(Revit.Elements)
clr.ImportExtensions(Revit.GeometryConversion)

clr.AddReference("RevitServices")
import RevitServices
from RevitServices.Persistence import DocumentManager
from RevitServices.Transactions import TransactionManager

doc = DocumentManager.Instance.CurrentDBDocument
view = doc.ActiveView
uidoc = DocumentManager.Instance.CurrentUIApplication.ActiveUIDocument

#Preparing input from dynamo to revit
pnt = UnwrapElement(IN[0])


OUT = [XYZ(i.X, i.Y, i.Z) for i in pnt]
# ----------------------------------------
pointsInCircum = Python(IN[1]=outRadisus, IN[2]=amount, IN[3]=center_xyz)  # IronPython2; unwired: IN[0], IN[4]
# ---------- pointsInCircum.python (30 lines) ----------
import math

r = IN[1]
n = IN[2]
cenPnt = IN[3]

cenPnt = (cenPnt[0].X, cenPnt[0].Y, cenPnt[0].Z)

def array(x, y, r):
    rx = (x*math.cos(r)) - (y*math.sin(r))
    ry = (y*math.cos(r)) + (x*math.sin(r))
    return (rx, ry)

def createPointsOnCircum(center, num_points, radius):
    arc = (2 * math.pi) / num_points 
    points = []
    for p in range(int(num_points)):
        (px,py) = array(0, radius, arc * p) 
        px += center[0]
        py += center[1]
        points.append((px,py,0))
    return points
    
 

		
		
pts = createPointsOnCircum(cenPnt,n, r)

OUT = pts
# ----------------------------------------
ox_oy_oz = Python(IN[1]=pointsInCircum)  # IronPython2; unwired: IN[0]
# ---------- ox_oy_oz.python (11 lines) ----------
def GetIndexOfList(lst,index): # Get a Value from Level 3 of a list by Index Number
    re = []
    for i in lst:
        c = i[index]
        re.append(c)
    return re

oX =  GetIndexOfList(IN[1], 0)
oY = GetIndexOfList(IN[1], 1)
oZ = GetIndexOfList(IN[1], 2)
OUT = oX, oY, oZ
# ----------------------------------------
code_block = CodeBlock(x=ox_oy_oz, y=ox_oy_oz, z=ox_oy_oz) { x[0]; y[1]; z[2]; }
code_block_2 = CodeBlock(t1=code_block.out0, t2=code_block.out1, t3=code_block.out2) { point1 = Point.ByCoordinates(t1, t2, t3); }
length = DoubleSlider(-11700, range=-11700..11700 step 100)  # graph input
code_block_3 = CodeBlock(x=ox_oy_oz, y=ox_oy_oz, z=ox_oy_oz, length=length) { x[0]; y[1]; z[2]+length; }
code_block_4 = CodeBlock(t1=code_block_3.out0, t2=code_block_3.out1, t3=code_block_3.out2) { point1 = Point.ByCoordinates(t1, t2, t3); }

# group: Odd point
length_2 = DoubleSlider(1000, range=-2000..2000 step 100)
getitematindex_evenpoint = Python(IN[0]=code_block_2)  # IronPython2
# ---------- getitematindex_evenpoint.python (8 lines) ----------
def getItemAtIndex(idx, lst): 
	if (idx % 2 != 0):
		return [lst[i] for i in range(1,len(lst), 2)]
	return [lst[i] for i in range(0,len(lst), 2)]
	


OUT = getItemAtIndex(1, IN[0])
# ----------------------------------------
offsetXYZ = Python(IN[0]=length_2, IN[1]=getitematindex_evenpoint)  # IronPython2
# ---------- offsetXYZ.python (29 lines) ----------
"""Copyright(c) 2019 by: duengocnguyen@gmail.com"""
'https://www.youtube.com/channel/UCt2JhCDDFxpYho575WTMZ4g'
"""________________Welcome to BIM3DM-DYNAMO API___________________"""
import clr 
import sys
sys.path.append(r'C:\Program Files\Autodesk\Revit 2020\AddIns\DynamoForRevit\IronPython.StdLib.2.7.8')
import math 
from System.Collections.Generic import *

clr.AddReference("ProtoGeometry")
from Autodesk.DesignScript.Geometry import *

clr.AddReference('RevitAPI')
import Autodesk
from Autodesk.Revit.DB import *








def offsetXYZ (length, points):
	offsetXYZ = [XYZ(points[i].X/304.8, points[i].Y/304.8 , points[i].Z+length/304.8) for i in range(len(points))]
	return offsetXYZ
	
length = IN[0]
OUT = offsetXYZ(length, IN[1])
# ----------------------------------------
xyz_point = Python(IN[0]=offsetXYZ)  # IronPython2
# ---------- xyz_point.python (39 lines) ----------
"""Copyright(c) 2019 by: duengocnguyen@gmail.com"""
'https://www.youtube.com/channel/UCt2JhCDDFxpYho575WTMZ4g'
"""________________Welcome to BIM3DM-DYNAMO API___________________"""
import clr 
import sys
sys.path.append(r'C:\Program Files\Autodesk\Revit 2020\AddIns\DynamoForRevit\IronPython.StdLib.2.7.8')
import math 
from System.Collections.Generic import *

clr.AddReference("ProtoGeometry")
from Autodesk.DesignScript.Geometry import *

clr.AddReference('RevitAPI')
import Autodesk
from Autodesk.Revit.DB import *

clr.AddReference('RevitAPIUI')
from Autodesk.Revit.UI import*
from  Autodesk.Revit.UI.Selection import*

clr.AddReference("RevitNodes")
import Revit
clr.ImportExtensions(Revit.Elements)
clr.ImportExtensions(Revit.GeometryConversion)

clr.AddReference("RevitServices")
import RevitServices
from RevitServices.Persistence import DocumentManager
from RevitServices.Transactions import TransactionManager

doc = DocumentManager.Instance.CurrentDBDocument
view = doc.ActiveView
uidoc = DocumentManager.Instance.CurrentUIApplication.ActiveUIDocument

#Preparing input from dynamo to revit
item = UnwrapElement(IN[0])


OUT = [i.ToPoint() for i in item]
# ----------------------------------------
getitematindex_evenpoint_2 = Python(IN[0]=code_block_4)  # IronPython2
# ---------- getitematindex_evenpoint_2.python (5 lines) ----------
def getItemAtIndex(idx, lst): 
	if (idx % 2 != 0):
		return [lst[i] for i in range(1,len(lst), 2)]
	return [lst[i] for i in range(0,len(lst), 2)]
OUT = getItemAtIndex(1, IN[0])
# ----------------------------------------
offsetXYZ_2 = Python(IN[0]=length_2, IN[1]=getitematindex_evenpoint_2)  # IronPython2
# ---------- offsetXYZ_2.python (29 lines) ----------
"""Copyright(c) 2019 by: duengocnguyen@gmail.com"""
'https://www.youtube.com/channel/UCt2JhCDDFxpYho575WTMZ4g'
"""________________Welcome to BIM3DM-DYNAMO API___________________"""
import clr 
import sys
sys.path.append(r'C:\Program Files\Autodesk\Revit 2020\AddIns\DynamoForRevit\IronPython.StdLib.2.7.8')
import math 
from System.Collections.Generic import *

clr.AddReference("ProtoGeometry")
from Autodesk.DesignScript.Geometry import *

clr.AddReference('RevitAPI')
import Autodesk
from Autodesk.Revit.DB import *








def offsetXYZ (length, points):
	offsetXYZ = [XYZ(points[i].X/304.8, points[i].Y/304.8 , (points[i].Z-length/304.8)*0 - (11700-length)/304.8) for i in range(len(points))]
	return offsetXYZ
	
length = IN[0]
OUT = offsetXYZ(length, IN[1])
# ----------------------------------------

xyz_point_2 = Python(IN[0]=offsetXYZ_2)  # IronPython2; same code as xyz_point

# group (continued): Odd point
byStartPointEndPoint = Python(IN[1]=xyz_point, IN[2]=xyz_point_2)  # "Line.ByStartPointEndPoint"; IronPython2; unwired: IN[0]
# ---------- byStartPointEndPoint.python (20 lines) ----------
"""Copyright(c) 2019 by: duengocnguyen@gmail.com"""
'https://www.youtube.com/channel/UCt2JhCDDFxpYho575WTMZ4g'
"""________________Welcome to BIM3DM-DYNAMO API___________________"""
import clr 
import sys
sys.path.append(r'C:\Program Files\Autodesk\Revit 2020\AddIns\DynamoForRevit\IronPython.StdLib.2.7.8')
clr.AddReference("ProtoGeometry")
from Autodesk.DesignScript.Geometry import *


def ConnectPointInCircum(pts1, pts2):
	line = []
	for ( p1, p2 ) in zip(pts1, pts2):
		line.append(Line.ByStartPointEndPoint(p1,p2))
	return line

pts1 = IN[1]
pts2 = IN[2]

OUT = ConnectPointInCircum(pts1, pts2)
# ----------------------------------------

# group: Even point
getitematindex_evenpoint_3 = Python(IN[0]=code_block_2)  # IronPython2
# ---------- getitematindex_evenpoint_3.python (5 lines) ----------
def getItemAtIndex(idx, lst): 
	if (idx % 2 != 0):
		return [lst[i] for i in range(1,len(lst), 2)]
	return [lst[i] for i in range(0,len(lst), 2)]
OUT = getItemAtIndex(2, IN[0])
# ----------------------------------------
getitematindex_evenpoint_4 = Python(IN[0]=code_block_4)  # IronPython2; same code as getitematindex_evenpoint_3
byStartPointEndPoint_2 = Python(IN[1]=getitematindex_evenpoint_3, IN[2]=getitematindex_evenpoint_4)  # "Line.ByStartPointEndPoint"; IronPython2; unwired: IN[0]; same code as byStartPointEndPoint

code_block_5 = CodeBlock(lst1=byStartPointEndPoint_2) { lst1; }
code_block_6 = CodeBlock(inRadius=outRadisus) { inRadius-1300; }
pointsInCircum_2 = Python(IN[1]=code_block_6, IN[2]=amount, IN[3]=center_xyz)  # IronPython2; unwired: IN[0], IN[4]; same code as pointsInCircum
ox_oy_oz_2 = Python(IN[1]=pointsInCircum_2)  # IronPython2; unwired: IN[0]; same code as ox_oy_oz
code_block_7 = CodeBlock(x=ox_oy_oz_2, y=ox_oy_oz_2, z=ox_oy_oz_2, length=length) { x[0]; y[1]; z[2]+length; }
code_block_8 = CodeBlock(t1=code_block_7.out0, t2=code_block_7.out1, t3=code_block_7.out2) { point1 = Point.ByCoordinates(t1, t2, t3); }
getitematindex_evenpoint_5 = Python(IN[0]=code_block_8)  # IronPython2; same code as getitematindex_evenpoint_3
byStartPointEndPoint_3 = Python(IN[1]=getitematindex_evenpoint_4, IN[2]=getitematindex_evenpoint_5)  # "Line.ByStartPointEndPoint"; IronPython2; unwired: IN[0]; same code as byStartPointEndPoint
code_block_9 = CodeBlock(lst2=byStartPointEndPoint_3) { lst2; }
python_script = Python(IN[1]=code_block_5, IN[2]=code_block_9)  # IronPython2; unwired: IN[0]
# ---------- python_script.python (30 lines) ----------
"""Copyright by: duengocnguyen@gmail.com"""
import clr 
import System
import math 
from System.Collections.Generic import *

clr.AddReference("ProtoGeometry")
from Autodesk.DesignScript.Geometry import *

clr.AddReference('RevitAPI')
import Autodesk
from Autodesk.Revit.DB import *

clr.AddReference('RevitAPIUI')
from Autodesk.Revit.UI import*
from  Autodesk.Revit.UI.Selection import*

clr.AddReference("RevitNodes")
import Revit
clr.ImportExtensions(Revit.Elements)
clr.ImportExtensions(Revit.GeometryConversion)

lst1 = IN[1]
lst2 = IN[2]

re = []
for line1, line2 in zip(lst1, lst2):
	result = Autodesk.DesignScript.Geometry.Curve.Join(line1, line2)
	re.append(result)
OUT = re
# ----------------------------------------
select_model_element = DSModelElementSelection()  # 1 picked in the model; graph input
code_block_10 = CodeBlock(e=select_model_element) { e.Id; }

# group: Creation of Horizontal Rebar in Revit
code_block_11 = CodeBlock(elementid=code_block_10) { elementid; }
rebar_style = RebarStyle("Standard", EnumerationType="Autodesk.Revit.DB.Structure.RebarStyle, RevitAPI, Version=22.0.0.0, Culture=neutral, PublicKeyToken=null")  # graph input
rebar_bar_type = RebarBarType("32M", ElementType="Autodesk.Revit.DB.Structure.RebarBarType, RevitAPI, Version=22.0.0.0, Culture=neutral, PublicKeyToken=null")  # graph input
rebar_hook_orientation = RebarHookOrientation("Left", EnumerationType="Autodesk.Revit.DB.Structure.RebarHookOrientation, RevitAPI, Version=22.0.0.0, Culture=neutral, PublicKeyToken=null")  # graph input
rebar_hook_type = RevitRebarHookType("None", ElementType="Autodesk.Revit.DB.Structure.RebarHookType, RevitAPI, Version=22.0.0.0, Culture=neutral, PublicKeyToken=null")  # graph input
normal = Curve.Normal(curve=python_script)
byCurve = Rebar.ByCurve(curve=python_script, hostElementId=code_block_11, rebarStyle=rebar_style, rebarBarType=rebar_bar_type, startHookOrientation=rebar_hook_orientation, endHookOrientation=rebar_hook_orientation, startHookType=rebar_hook_type, endHookType=rebar_hook_type, vector=normal)
