# Dynamo graph superGetSetParameter.dyn (Dynamo 2.10.1.3976)
# packages: BIM3DM 2.1.24

code_block = CodeBlock { ["Structural Columns", "Structural Framing"]; }
boolean = BoolSelector(false)
selectionElementsByCategoryName = Custom[SelectionElementsByCategoryName](categoryNames=code_block, reset=boolean)  # package BIM3DM; Use the PickElementsByRectangle method to manipulate this node. Returning the objects you want to select based on the name of the category you pass as a parameter.
code_block_2 = CodeBlock()
# ---------- code_block_2.designscript (10 lines) ----------
["終端 梁幅",
"終端 梁せい",
"TO_符号",
"Mark",
"Comments",
"Type Mark",
"Ket Note",
"Cost",
"Start Level Offset",
"End Level Offset"];
# ----------------------------------------
boolean_2 = BoolSelector(false)
elementsSuperGetParameterValueByNames = Custom[ElementsSuperGetParameterValueByNames](elements=selectionElementsByCategoryName, parameters=code_block_2, showAll=boolean_2)  # package BIM3DM; Extracting the values of parameters that you pass as input: Note: You can pass an array of parameter values and individual elements as well.
code_block_3 = CodeBlock(values=elementsSuperGetParameterValueByNames.emptyField) { values; }
code_block_4 = CodeBlock()
# ---------- code_block_4.designscript (8 lines) ----------
["柱せい",
"柱幅",
"TO_符号",
"Mark",
"Comments",
"Type Mark",
"Ket Note",
"Cost"];
# ----------------------------------------
code_block_5 = CodeBlock()
# ---------- code_block_5.designscript (6 lines) ----------
[800,
1800,
"BIM3DM",
"Dynamo API Python",
"Dynamo"
];
# ----------------------------------------
elementsSuperSetParameterValueByNames = Custom[ElementsSuperSetParameterValueByNames](elements=selectionElementsByCategoryName, parameters=code_block_4, values=code_block_5)  # package BIM3DM; To set the values of parameters that you pass as input: Note: You can pass an array of parameter values and individual elements as well.
code_block_6 = CodeBlock(values=elementsSuperGetParameterValueByNames.values) { values; }
