# Dynamo graph Set Parameter By Name.dyn (Dynamo 2.0.3.8810)

select_element = Python()  # "Select-Element.GetParameterValueByName"; unwired: IN[0]
# ---------- select_element.python (28 lines) ----------
import clr
clr.AddReference('RevitAPI')
import Autodesk
from Autodesk.Revit.DB import *

clr.AddReference("RevitServices")
import RevitServices
from RevitServices.Persistence import DocumentManager

clr.AddReference("RevitAPIUI")
from  Autodesk.Revit.UI import *

clr.AddReference("RevitNodes")
import Revit
clr.ImportExtensions(Revit.GeometryConversion)



doc = DocumentManager.Instance.CurrentDBDocument
uidoc=DocumentManager.Instance.CurrentUIApplication.ActiveUIDocument

sel  = uidoc.Selection

obType = Selection.ObjectType.Element
ref = sel.PickObject(obType, "🐶🐶🐶 Please!!!Seclect A Elemnets To Getttttttttttt Value.🐶🐶🐶🐶 ")
element = doc.GetElement(ref.ElementId)

OUT = element
# ----------------------------------------
parameter_name___get = StringInput("Offset")  # graph input
getParameterValueByName = Element.GetParameterValueByName(element=select_element, parameterName=parameter_name___get)
setParameterByName = Python()  # "Element.SetParameterByName"; unwired: IN[0]
# ---------- setParameterByName.python (28 lines) ----------
import clr
clr.AddReference('RevitAPI')
import Autodesk
from Autodesk.Revit.DB import *

clr.AddReference("RevitServices")
import RevitServices
from RevitServices.Persistence import DocumentManager

clr.AddReference("RevitAPIUI")
from  Autodesk.Revit.UI import *

clr.AddReference("RevitNodes")
import Revit
clr.ImportExtensions(Revit.GeometryConversion)



doc = DocumentManager.Instance.CurrentDBDocument
uidoc=DocumentManager.Instance.CurrentUIApplication.ActiveUIDocument

sel  = uidoc.Selection

obType = Selection.ObjectType.Element
ref = sel.PickObject(obType, "🐶🐶🐶 Please!!!Seclect A Elemnets To Setttttttttttt Value.🐶🐶🐶🐶 ")
element = doc.GetElement(ref.ElementId)

OUT = element
# ----------------------------------------
parameter_name___set = StringInput("Offset")  # graph input
setParameterByName_2 = Element.SetParameterByName(element=setParameterByName, parameterName=parameter_name___set, value=getParameterValueByName)
check = CodeBlock(a=getParameterValueByName, b=setParameterByName_2) { a==b; }
check_2 = FromObject(obj=check)  # graph output
